vi "Main Window.gvi"   [LabVIEW NXG 5.0.0]
panel controls:
  "Main Tab control": i32
  "Automatic Measurement Indicators": "Automatic Measurement Indicators.gtype"
  "Advanced Config Tab": i32
  "Global Abort": bool  # Force exit either the current process or the entire app (you will be prompted)
  "New Calibration": bool
  "Load Calibration": bool
  "Save Calibration": bool
  "End Wavelength (nm)": f64 = 1100
  "Start Wavelength (nm)": f64 = 400
  "Wavelength Step (nm)": f64 = 1
  "Light Power Calibration Data": f64[][]
  "Current Date": string
  "Custom date": bool
  "Author Initials": string
  "Batch Name": string
  "Cell Number": string
  "Sample Comments": string
  "Default Data Saving Location": path = path "D:\\measurements\\EQE measurements"
  "Powermeter Averages": f64 = 3
  "Exit App": bool  # Exit the application while waiting for everything to finish
  "Current Averages": f64 = 3
  "Acquire Manual EQE": bool
  "Save current EQE TXT": bool
  "Voltage Applied (V)": f64
  "Autorange": bool = TRUE
  "Dark Current": bool = TRUE
  "Manual Current Range": f64 = 1e-08
  "Monochromator configuration file": path
  "Desired λ (nm)": f64 = 500
  "Set desired wavelength": bool
  "Max current": f64 = 0.1
  "Full EQE Data": f64[][]
  "Dark Current Averages": f64 = 30
  "Carriage Arduino Status": bool
  "Multiplexer Arduino Status": bool
  "Filter Arduino Status": bool
  "Automatic Acquire": bool
  "Current Averages": f64 = 1
  "Voltage Applied (V)": f64
  "Autorange": bool = TRUE
  "Dark Current": bool = TRUE
  "Manual Range": f64 = 1e-08
  "All": bool
  "Reset": bool
  "Cell Data Cluster": "Cell Data Cluster 2.gtype"
  "Random Cell Order": bool
  "Cell Measuring Labels": string[]
  "VISA Resource Name": "VISA Instr"
  "Automatic EQE Measurement Data": cluster{"Element 1": f64[], "Element 2": f64[]}[]
  "X position": f64
  "Z position": f64
  "Activate Arduino": bool
  "Set Postion": bool
  "Release Arduino": bool
  "Supercontinuum Status": bool
  "Laser Status": bool
  "Cell Label": T1 = "L.01"
  "Custom Position": bool
  "Automatic EQE Measurement Graph_2": cluster{"Element 1": f64[], "Element 2": f64[]}[]
  "Monochromator": bool
  "Monochromator configuration file infrared": path
  "Monochromator configuration file visible": path
  "Wavelength for peak detection": f64 = 500
  "Save Ref Coordinates": bool
  "Desired Cell": T1 = "L.01"
  "Set Multiplexor Cell": bool
  "Progress %": f64
  "Skip to Next Cell": bool
  "Keithley Enable Output": bool
  "Keithley Disable Output": bool
  "Manual Current Range.": f64
  "Voltage Applied (V).": f64
  "Source Limit Level.": f64 = 0.1
  "Current Averages.": i32 = 3
  "Enable Auto Range": bool = TRUE
  "R.01 Reference Coordinates": "R.01 Reference Coordinates.gtype" = {"X coordinate R.01"=124.92, "Z coordinate R.01"=18, "Vertical Spacing"=6}
  "R.01 Scan?": bool
  "Z scan steps": f64 = 6
  "X scan Range (mm)": f64 = 5
  "Z scan Range (mm)": f64 = 4
  "X scan steps": f64 = 8
  "Save R.01 Coordinate?": bool
  "Prechck Cell": bool = TRUE
  "Dead Current Threshold": f64 = 1e-11
panel indicators:
  "Light Calibration": cluster{"Element 1": f64[], "Element 2": f64[]}
  "EQE Measurement": cluster{"Element 1": f64[], "Element 2": f64[]}
  "Automatic EQE Measurement Graph": cluster{"Element 1": f64[], "Element 2": f64[]}[]
  "Light Power (W)": f64
  "Abort All": bool
  "Current Wavelength (nm)": f64
  "Sample Prefix": string
  "Label Info Missing Error": bool
  "Label Info Error Label": string
  "Current (A)": f64
  "Wavelength (nm)": f64
  "EQE (%)": f64
  "Dark Current (A)": f64
  "End Wavelength (nm) Current Calibration": f64
  "Start Wavelength (nm) Current Calibration": f64
  "Wavelength Step (nm) Current Calibration": f64
  "Current State Output": "Queue instructions.gtype"
  "Photodetector Names": string[]
  "Monochromator Name": string
  "Keithley Address": "VISA Instr"
  "Current λ (nm)": f64
  "Keythley Status": bool
  "Photodetector Status": bool
  "Monochromator Status": bool
  "Carriage Arduino Address": "VISA Instr"
  "Multiplexer Arduino Address": "VISA Instr"
  "Filter Arduino Address": "VISA Instr"
  "Cell Measuring Order": string
  "XZ Carriage Arduino Log": string
  "Arduino Multiplexer Log": string
  "Error Out": error
  "Sub states Output": "Sub states enum.gtype"
  "Carriage Active": bool
  "Supercontinuum laser Address": "VISA Instr"
  "Laser Current Power": f64
  "Initialized?": bool
  "Reference Coordinates file": path
  "Arduino Multiplexer Log.": string
  "Filter Status": bool
  "Filter Flipper Log": string
  "Keithley Current Measurement": string
  "XZ Scan Intensity Graph": f64[][]
  "Progress counter": f64
  "State": string
  "Substate": string
types:
  "Automatic Measurement Indicators.gtype" = cluster{"Elapsed Time (kr)": f64, "Estimated Time (kr)": f64, "Cell being measured": string, "Current Value (A)  ": f64, "EQE (%)": f64, "Dark Current (A)": f64}
  "Queue instructions.gtype" = enum{"Wrongly pointed State", "Initialize App", "Light Calibration", "Measure Photodetector", "Measure Keithley", "Instrument detection", "Single Acquire", "Multiple Acquire", "EQE Mapping", "Debugging mode", "Move Arduino", "Arduino FF flip filter", "Help routine", "Idle", "Save Calibration", "Load Calibration", "Set Wavelength", "Help Wizard", "Turn supercontinuum laser on/off", "Save R.01 Coordinates", "Set Multiplex arduino cell", "Save TXT EQE file", "Load TXT EQE", "Stop or Idle", "Stop App"}
  "Cell Data Cluster 2.gtype" = cluster{"R.01": bool, "L.01": bool, "R.02": bool, "L.02": bool, "R.03": bool, "L.03": bool, "R.04": bool, "L.04": bool, "R.05": bool, "L.05": bool, "R.06": bool, "L.06": bool, "R.07": bool, "L.07": bool, "R.08": bool, "L.08": bool, "R.09": bool, "L.09": bool, "R.10": bool, "L.10": bool, "R.11": bool, "L.11": bool, "R.12": bool, "L.12": bool}
  "Sub states enum.gtype" = enum{"Not specified", "Measuring Dark Current", "Initializing Keithley", "Initializing Monochromator", "Measuring with Keithley", "Moving Arduino", "Detecting Monochromator", "Detecting Keithley", "Detecting Photodetector", "Detecting Arduinos", "Homing XZ Carriage Arduino", "Moving XZ Carriage Arduino", "Moving Filter Flipper Arduino", "Setting Pin Multiplexer Arduino", "Detecting Supercontinuum", "Scanning R.01 cell position", "Prechecking Cells"}
  T1 = enum{"L.01", "L.02", "L.03", "L.04", "L.05", "L.06", "L.07", "L.08", "L.09", "L.10", "L.11", "L.12", "R.01", "R.02", "R.03", "R.04", "R.05", "R.06", "R.07", "R.08", "R.09", "R.10", "R.11", "R.12"}
  "R.01 Reference Coordinates.gtype" = cluster{"X coordinate R.01": f64, "Z coordinate R.01": f64, "Vertical Spacing": f64}
  "Reset Disabled Controls Cluster.gtype" = cluster{"Custom date": bool, "Autorange ": bool, "Dead Current Threshold Reference": "NumericTextBoxDouble reference", "Manual Range Reference": "NumericTextBoxDouble reference", "Dark Current Averages Reference": "NumericTextBoxDouble reference", "Current Date Reference": "StringControl reference", "Manual Current Range Reference": "NumericTextBoxDouble reference", "Skip To Next Cell Reference": "BooleanControl reference", "Z position Reference": "NumericTextBoxDouble reference", "Keithley Disable Output Reference": "BooleanControl reference", "X position Reference": "NumericTextBoxDouble reference"}
  T2 = cluster{"Element 1": f64, "Element 2": f64, "Element 3": bool}
  "Light Calibration Input Parameters.gtype" = cluster{"Notifier Input": Notifier<T2>, "Wavelength Step (nm)": f64, "End Wavelength (nm)": f64, "Start Wavelength (nm)": f64, "Filter Arduino Status": bool, "Arduino Filter Flipper Address": "VISA Instr", "Monochromator": bool, "Powermeter Averages": u16, "Configuration File": path}
  "Single Acquire Notification control.gtype" = cluster{"Wavelength (nm)": f64, "EQE (%)": f64, "Current (A)": f64, "Finnished": bool, "Progress": f64}
  "Single acquire inputs control.gtype" = cluster{"Light calibration data": f64[][], "Fiannium Configuration File": path, "Arduino Filter Flipper Address": "VISA Instr", "Filter Arduino Status": bool, "Dark Current Averages": f64, "Measure dark current?": bool, "Keithley Address": "VISA Instr", "Current Aveages": i32, "Voltage Applied (V)": f64, "Max current compliance": f64, "Manual Current Range": f64, "Enable Auto Range": bool, "Automatic measurement": bool, "Fiannium Pe Handler": u64, "Dead Cell? Current Threshold": f64, "Automatic measurement Cell Dark current": f64, "Monocrhomator": bool}
  "Multiple aquire notification constant.gtype" = cluster{"Current Value (A)  ": f64, "EQE (%)": f64, "Dark Current (A)": f64, "Cell being measured": string, "Automatic EQE Measurement Graph": cluster{"Element 1": f64[], "Element 2": f64[]}[], "Finished": bool, "Current Wavelength": f64, "Progress": f64}
  "Multiple acquire variables control.gtype" = cluster{"Monochromator configuration file ": path, "Light Power Calibration Data": f64[][], "Cell Measuring Labels": string[], "Sample Prefix": string, "Author Initials": string, "Current Date": string, "Batch Name": string, "Default Data Saving Location": path, "Filter Arduino Status": bool, "Filter Arduino Address": "VISA Instr", "Multiplexer Arduino Address": "VISA Instr", "Carriage Arduino Address": "VISA Instr", "Keithley Address": "VISA Instr", "Current Averages   ": f64, "Manual Range  ": f64, "Max current": f64, "Voltage Applied (V)  ": f64, "Autorange  ": bool, "Dark Current  ": bool, "Wavelength for peak detection": f64, "R.01 Reference Coordinates": "R.01 Reference Coordinates.gtype", "R.01 Scan?": bool, "Z scan steps": f64, "X scan Range (mm)": f64, "Z scan Range (mm)": f64, "X scan steps": f64, "Reference Coordinates file": path, "Save R.01 Coordinate?": bool, "Fianium Pe Handler": u64, "Automatic Measurement?": bool, "Dead Cell 10mV Current Threshold": f64, "Precheck cells?": bool, "Monochromator": bool}
uses:
  EQE_Measuring_Setup_NanOpto::SubVis::Main Sub Functions::Start instruction queue.gvi
  EQE_Measuring_Setup_NanOpto::SubVis::Main Sub Functions::Global Abort::Global Abort instruction subroutine.gvi
  EQE_Measuring_Setup_NanOpto::SubVis::Main Sub Functions::Light Calibration::Light Calibration Instruction Subroutine.gvi
  EQE_Measuring_Setup_NanOpto::SubVis::Main Sub Functions::Sample name check up subroutine.gvi
  EQE_Measuring_Setup_NanOpto::SubVis::FGV::Sample Prefix FGV.gvi
  EQE_Measuring_Setup_NanOpto::SubVis::FGV::Arduino filter FGV current state.gvi
  EQE_Measuring_Setup_NanOpto::SubVis::Main Sub Functions::Timeout instruction subroutine.gvi
  EQE_Measuring_Setup_NanOpto::SubVis::Main Sub Functions::Exit app instruction subroutine.gvi
  EQE_Measuring_Setup_NanOpto::SubVis::Main Sub Functions::Light Calibration::Load Calibration instruction subroutine.gvi
  EQE_Measuring_Setup_NanOpto::SubVis::Main Sub Functions::Light Calibration::Save calibration check up instruction subroutine.gvi
  EQE_Measuring_Setup_NanOpto::SubVis::Utilities::Prerequisite detection::Single Acquire Prerequisite Detection.gvi
  EQE_Measuring_Setup_NanOpto::SubVis::Main Sub Functions::Set desired Wavelength subroutine.gvi
  EQE_Measuring_Setup_NanOpto::SubVis::Main Sub Functions::Acquire::Save current EQE TXT instruction subroutine.gvi
  EQE_Measuring_Setup_NanOpto::SubVis::Utilities::Prerequisite detection::Multiple Acquire Prerequisite Detection.gvi
  EQE_Measuring_Setup_NanOpto::SubVis::Main Sub Functions::Acquire::Multiple Acquire::Auto Measurement Cell selection subroutine.gvi
  EQE_Measuring_Setup_NanOpto::SubVis::Utilities::Prerequisite detection::Move Arduino Prerequisites.gvi
  EQE_Measuring_Setup_NanOpto::SubVis::Instrument Control::Supercontinuum Laser Source::Supercontinuum laser prerequisites and warning.gvi
  EQE_Measuring_Setup_NanOpto::SubVis::Main Sub Functions::Monochromator switch Subroutine.gvi
  EQE_Measuring_Setup_NanOpto::SubVis::Utilities::Other::Wavelength Coercer.gvi
  EQE_Measuring_Setup_NanOpto::SubVis::Utilities::Path Manipulation::Update Reference Coordinates subroutine.gvi
  EQE_Measuring_Setup_NanOpto::SubVis::Main Sub Functions::Check If other tasks active subroutine.gvi
  EQE_Measuring_Setup_NanOpto::SubVis::Main Sub Functions::Acquire::Multiple Acquire::Skip to next cell subroutine.gvi
  EQE_Measuring_Setup_NanOpto::SubVis::Main Sub Functions::Error Detected STOP subroutine.gvi
  EQE_Measuring_Setup_NanOpto::SubVis::FGV::Current State FGV.gvi
  EQE_Measuring_Setup_NanOpto::SubVis::Utilities::Other::Enum reset instructions argument extract.gvi
  EQE_Measuring_Setup_NanOpto::SubVis::Main Sub Functions::Initialize App::Reset Disabled Controls Subroutine.gvi
  EQE_Measuring_Setup_NanOpto::SubVis::Main Sub Functions::Global Abort::Global Abort.gvi
  EQE_Measuring_Setup_NanOpto::SubVis::FGV::Arduino Homed FGV.gvi
  EQE_Measuring_Setup_NanOpto::SubVis::FGV::Skip To next Cell FGV.gvi
  NI::G Core::Strings::Search and Replace Pattern.gvi
  EQE_Measuring_Setup_NanOpto::SubVis::Instrument Control::Monochromator::Check Monochromator Config File.gvi
  EQE_Measuring_Setup_NanOpto::SubVis::Main Sub Functions::Check Reference coordinate file.gvi
  EQE_Measuring_Setup_NanOpto::SubVis::Main Sub Functions::Light Calibration::Light Calibration Initialization Sequence.gvi
  EQE_Measuring_Setup_NanOpto::SubVis::Main Sub Functions::Light Calibration::Light calibration.gvi
  EQE_Measuring_Setup_NanOpto::SubVis::Main Sub Functions::Light Calibration::Light Calibration Notification Handler.gvi
  EQE_Measuring_Setup_NanOpto::SubVis::Main Sub Functions::Light Calibration::Light Calibration Closing Subroutine.gvi
  EQE_Measuring_Setup_NanOpto::SubVis::Utilities::Other::Graph Adapter.gvi
  EQE_Measuring_Setup_NanOpto::SubVis::Instrument Control::Instrument Detection Sequence.gvi
  EQE_Measuring_Setup_NanOpto::SubVis::Main Sub Functions::Laser power extractor.gvi
  EQE_Measuring_Setup_NanOpto::SubVis::Instrument Control::Supercontinuum Laser Source::Supercontinuum Shut Down Sequence.gvi
  EQE_Measuring_Setup_NanOpto::SubVis::Instrument Control::Supercontinuum Laser Source::Supercontinuum Warm Up Sequence.gvi
  EQE_Measuring_Setup_NanOpto::SubVis::Main Sub Functions::Light Calibration::Save Calibration File.gvi
  EQE_Measuring_Setup_NanOpto::SubVis::Main Sub Functions::Light Calibration::Load Calibration file.gvi
  EQE_Measuring_Setup_NanOpto::SubVis::Main Sub Functions::Acquire::Single Acquire::Single EQE Measurement Acquire.gvi
  EQE_Measuring_Setup_NanOpto::SubVis::Main Sub Functions::Acquire::Single Acquire::Single Acquire Close Subroutine.gvi
  EQE_Measuring_Setup_NanOpto::SubVis::Instrument Control::Monochromator::Set Desired Wavelength Slave Subroutine.gvi
  EQE_Measuring_Setup_NanOpto::SubVis::Instrument Control::Arduinos::Multiplexer Arduino::Multiplexer Arduino Control.gvi
  EQE_Measuring_Setup_NanOpto::SubVis::Instrument Control::Arduinos::Filter Flipper Arduino::Arduino Filter Flipper Control.gvi
  EQE_Measuring_Setup_NanOpto::SubVis::Main Sub Functions::Acquire::Save EQE TXT File.gvi
  EQE_Measuring_Setup_NanOpto::SubVis::Main Sub Functions::Acquire::Multiple Acquire::Multiple Acquire initialize.gvi
  EQE_Measuring_Setup_NanOpto::SubVis::Main Sub Functions::Acquire::Multiple Acquire::Multiple Acquire Notification Handler.gvi
  EQE_Measuring_Setup_NanOpto::SubVis::Main Sub Functions::Acquire::Multiple Acquire::Automatic Measurement Graph Postprocessor.gvi
  EQE_Measuring_Setup_NanOpto::SubVis::Main Sub Functions::Acquire::Multiple Acquire::Dead Cell Check.gvi
  EQE_Measuring_Setup_NanOpto::SubVis::Main Sub Functions::Acquire::Multiple Acquire::Multiple acuire precheck cells.gvi
  EQE_Measuring_Setup_NanOpto::SubVis::Main Sub Functions::Acquire::Multiple Acquire::Multiple Aquire Sequence.gvi
  EQE_Measuring_Setup_NanOpto::SubVis::Main Sub Functions::Acquire::Multiple Acquire::Multiple Acquire Graph update and close.gvi
  EQE_Measuring_Setup_NanOpto::SubVis::Main Sub Functions::Move Arduino Initialize Subroutine.gvi
  EQE_Measuring_Setup_NanOpto::SubVis::Instrument Control::Arduinos::XZ Carriage Arduino::XZ Carriage Arduino Homing Sequence.gvi
  EQE_Measuring_Setup_NanOpto::SubVis::Instrument Control::Arduinos::XZ Carriage Arduino::XZ Carriage Label to Coordinate.gvi
  EQE_Measuring_Setup_NanOpto::SubVis::Instrument Control::Arduinos::XZ Carriage Arduino::XZ Coordinate to Gcode command.gvi
  EQE_Measuring_Setup_NanOpto::SubVis::Instrument Control::Arduinos::XZ Carriage Arduino::XZ Carriage Arduino Move to location.gvi
  EQE_Measuring_Setup_NanOpto::SubVis::Main Sub Functions::Move Arduino Close Subroutine.gvi
  EQE_Measuring_Setup_NanOpto::SubVis::Instrument Control::Keithley::Keithley Initialization Sequence.gvi
  Labview_NXG_Keithley_SMU_2450_2460_2461::Action Status::Enable Output.gvi
  Labview_NXG_Keithley_SMU_2450_2460_2461::Data::Make Reading and Store in Buffer.gvi
  Labview_NXG_Keithley_SMU_2450_2460_2461::Data::Read (Single Point).gvi
  Labview_NXG_Keithley_SMU_2450_2460_2461::Miscelaneous::Close.gvi
  EQE_Measuring_Setup_NanOpto::SubVis::Main Sub Functions::Terminate Queue.gvi
diagram:
  call "Start instruction queue.gvi"() -> (Queue Out=w1, Reset Initialized=w2, Error Out=w3)
  $"Initialized?" <- w2
  s1 = w3  # shift register
  while {
    # Instruction loop (Master)
    event (timeout = 500) {
      on "Global Abort" Mouse up {
        call "Global Abort instruction subroutine.gvi"(Queue In=w1, Global Abort=$"Global Abort", Error In=s1) -> (Queue Out=w5, Global Abort full=w6, Error Out=w4)
      }
      on "New Calibration" Value changed {
        call "Light Calibration Instruction Subroutine.gvi"(Queue In=w1, New Calibration=$"New Calibration", Start Wavelength (nm)=$"Start Wavelength (nm)", Label Info Missing Error=$"Label Info Missing Error", End Wavelength (nm)=$"End Wavelength (nm)", Filter Arduino Status=$"Filter Arduino Status", Label Info Error Label=$"Label Info Error Label", Error In=s1) -> (Queue Out=w5, Current State Output=w7, Error Out=w4)
        $"Current State Output" <- w7
        w6 = default
      }
      on "Author Initials" Value changed; "Batch Name" Value changed; "Cell Number" Value changed; "Current Date" Value changed; "Custom date" Value changed; "Main Tab control" Value changed; "Sample Comments" Value changed; "Sample Prefix" Value changed {
        call "Sample name check up subroutine.gvi"(Current Date ref=reference to "Current Date", Cell Number ref=reference to "Cell Number", Author Initials=$"Author Initials", Custom date=$"Custom date", Current Date In=$"Current Date", Batch Name=$"Batch Name", Main Tab control=$"Main Tab control", Sample Comments=$"Sample Comments", Cell Number=$"Cell Number") -> (Current Date=w8, Sample Prefix=w9, Label Info Missing Error=w10, Label Info Error Label=w11)
        $"Current Date" <- w8
        $"Sample Prefix" <- w9
        call "Sample Prefix FGV.gvi"(General instruction FGV enum="Set State", Sample Prefix=w9, Error In=s1) -> (Error Out=w4)
        $"Label Info Missing Error" <- w10
        $"Label Info Error Label" <- w11
        w5 = w1
        w6 = default
      }
      on "Timeout" {
        call "Arduino filter FGV current state.gvi"(Arduino Filter Flipper FGV instructions="Read State", Error In=s1) -> (Flipper State Boolean=w12, Error Out=w13)
        call "Timeout instruction subroutine.gvi"(Activate Arduino Reference=reference to "Activate Arduino", Set Position Reference=reference to "Set Postion", Release arduino Reference=reference to "Release Arduino", Initialized? Reference=reference to "Initialized?", Initialized?=$"Initialized?", Carriage Active=$"Carriage Active", Error In=w13) -> (Output=w6, Current State Output=w14, Sub states Output=w15, Error Out=w16)
        $"Current State Output" <- w14
        $"Filter Status" <- w12
        $"Sub states Output" <- w15
        Format Into String(errIn=w16, w14) -> (outString=w17, errOut=w18)
        Format Into String(errIn=w18, w15) -> (outString=w19, errOut=w4)
        $Substate <- w19
        $State <- w17
        w5 = w1
      }
      on "Exit App" Value changed {
        call "Exit app instruction subroutine.gvi"(Input=w1, Exit App=$"Exit App", Input_2=s1) -> (Output_2=w5, Output=w4)
        w6 = default
      }
      on "Load Calibration" Value changed {
        call "Load Calibration instruction subroutine.gvi"(Input=w1, Current State Output=$"Current State Output", Load Calibration=$"Load Calibration", Input_2=s1) -> (Output_2=w5, Output=w4)
        w6 = default
      }
      on "Save Calibration" Value changed {
        call "Save calibration check up instruction subroutine.gvi"(Input=w1, Save Calibration=$"Save Calibration", Light Power Calibration Data=$"Light Power Calibration Data", Current State Output_2=$"Current State Output", Label Info Missing Error=$"Label Info Missing Error", Label Info Error Label=$"Label Info Error Label", Input_2=s1) -> (Output_2=w5, Current State Output=w20, Output=w4)
        $"Current State Output" <- w20
        w6 = default
      }
      on "Autorange" Value changed {
        Property Node(instance in=reference to "Manual Current Range", "Disabled"=$Autorange, error in=s1) -> (error out=w4)
        w5 = w1
        w6 = default
      }
      on "Dark Current" Value changed {
        Not(x=$"Dark Current") -> w21
        Property Node(instance in=reference to "Dark Current (A)", "Disabled"=w21, error in=s1) -> (error out=w22)
        Property Node(instance in=reference to "Dark Current Averages", "Disabled"=w21, error in=w22) -> (error out=w4)
        w5 = w1
        w6 = default
      }
      on "Acquire Manual EQE" Value changed {
        call "Single Acquire Prerequisite Detection.gvi"(Queue In=w1, Acquire Manual EQE=$"Acquire Manual EQE", Filter Arduino Status=$"Filter Arduino Status", Label Info Missing Error=$"Label Info Missing Error", Label Info Error Label=$"Label Info Error Label", Light Power Calibration Data=$"Light Power Calibration Data", Error In=s1) -> (Queue Out=w5, Current State Output=w23, Error Out=w4)
        $"Current State Output" <- w23
        w6 = default
      }
      on "Set desired wavelength" Value changed {
        call "Set desired Wavelength subroutine.gvi"(Input=w1, Set desired wavelength=$"Set desired wavelength", Current State Output=$"Current State Output", Error In=s1) -> (Queue Out=w5, Error Out=w4)
        w6 = default
      }
      on "Save current EQE TXT" Value changed {
        call "Save current EQE TXT instruction subroutine.gvi"(Queue In=w1, Full EQE Data=$"Full EQE Data", Label Info Missing Error=$"Label Info Missing Error", Save current EQE TXT=$"Save current EQE TXT", Label Info Error Label=$"Label Info Error Label", Current State Output=$"Current State Output", Error In=s1) -> (Queue Out=w5, Error Out=w4)
        w6 = default
      }
      on "Autorange" Value changed {
        Property Node(instance in=reference to "Manual Range", "Disabled"=$Autorange)
        w4 = s1
        w5 = w1
        w6 = default
      }
      on "Automatic Acquire" Value changed {
        call "Multiple Acquire Prerequisite Detection.gvi"(Filter Arduino Status=$"Filter Arduino Status", Carriage Arduino Status=$"Carriage Arduino Status", Multiplexer Arduino Status=$"Multiplexer Arduino Status", Queue In=w1, Acquire Automatic EQE=$"Automatic Acquire", Cell Measuring Labels=$"Cell Measuring Labels", Label Info Missing Error=$"Label Info Missing Error", Label Info Error Label=$"Label Info Error Label", Light Power Calibration Data=$"Light Power Calibration Data", Error In=s1) -> (Queue Out=w5, Current State Output=w24, Error Out=w4)
        $"Current State Output" <- w24
        w6 = default
      }
      on "All" Value changed; "Cell Data Cluster" Value changed; "Random Cell Order" Value changed; "Reset" Value changed {
        call "Auto Measurement Cell selection subroutine.gvi"(Queue In=reference to "All", Random Cell Order=$"Random Cell Order", Reset=$Reset, All=$All, Cell Data Cluster_2=$"Cell Data Cluster", Error In=s1) -> (Cell Measuring Order=w25, Cell Measuring Labels=w26, Cell Data Cluster=w27, Error Out=w4)
        $"Cell Measuring Order" <- w25
        $"Cell Data Cluster" <- w27
        $"Cell Measuring Labels" <- w26
        w5 = w1
        w6 = default
      }
      on "Activate Arduino" Value changed {
        call "Move Arduino Prerequisites.gvi"(Input=w1, Set Position=$"Activate Arduino", Carriage Arduino Status=$"Carriage Arduino Status", Error In=s1) -> (Output_2=w5, Error Out=w4)
        w6 = default
      }
      on "Laser Status" Value changed {
        Event Data() -> ("Old Value"=w28, "New Value"=w29)
        call "Supercontinuum laser prerequisites and warning.gvi"(Input_2=w1, Old Value=w28, New Value=w29, Supercontinuum Status=$"Supercontinuum Status", Input=s1) -> (Output=w5, Laser Status=w30, Output_2=w4)
        $"Laser Status" <- w30
        w6 = default
      }
      on "Custom Position" Value changed {
        Not(x=$"Custom Position") -> w31
        Property Node(instance in=reference to "Z position", "Disabled"=w31, error in=s1) -> (error out=w32)
        Property Node(instance in=reference to "X position", "Disabled"=w31, error in=w32) -> (error out=w4)
        w5 = w1
        w6 = default
      }
      on "Monochromator" Value changed {
        call "Monochromator switch Subroutine.gvi"(Monochromator configuration file visible=$"Monochromator configuration file visible", Monochromator configuration file infrared=$"Monochromator configuration file infrared", Monochromator=$Monochromator, Input=s1) -> (Monochromator configuration file=w33, Monochromator_2=w34, Output=w4)
        $"Monochromator configuration file" <- w33
        $Monochromator <- w34
        w5 = w1
        w6 = default
      }
      on "Desired λ (nm)" Value changed; "End Wavelength (nm)" Value changed; "Start Wavelength (nm)" Value changed {
        call "Wavelength Coercer.gvi"(Start Wavelength (nm)=$"Start Wavelength (nm)", End Wavelength (nm)=$"End Wavelength (nm)", Desired λ (nm)=$"Desired λ (nm)", Error In=s1, Monochromator=$Monochromator) -> (Start Wavelength (nm) out=w35, End Wavelength (nm) out=w36, Desired λ (nm) Out=w37, Error Out=w4)
        $"Start Wavelength (nm)" <- w35
        $"Desired λ (nm)" <- w37
        $"End Wavelength (nm)" <- w36
        w5 = w1
        w6 = default
      }
      on "Save Ref Coordinates" Value changed {
        call "Update Reference Coordinates subroutine.gvi"(Reference Coordinates file=$"Reference Coordinates file", R.01 Reference Coordinates=$"R.01 Reference Coordinates", Error In=s1) -> (Error Out=w4)
        w5 = w1
        w6 = default
      }
      on "Set Multiplexor Cell" Value changed {
        w38 = "Set Multiplex arduino cell"  # Enum instructions
        call "Check If other tasks active subroutine.gvi"(Queue In=w1, Desired Task=w38, Error In=s1) -> (Queue Out=w5, Error out=w4)
        w6 = default
      }
      on "Filter Status" Mouse up {
        call "Check If other tasks active subroutine.gvi"(Queue In=w1, Desired Task="Arduino FF flip filter", Error In=s1) -> (Queue Out=w5, Error out=w4)
        w6 = default
      }
      on "Skip to Next Cell" Value changed {
        call "Skip to next cell subroutine.gvi"(Error In=s1) -> (Error Out=w4)
        w5 = w1
        w6 = default
      }
      on "Keithley Enable Output" Value changed {
        call "Check If other tasks active subroutine.gvi"(Queue In=w1, Desired Task="Measure Keithley", Error In=s1) -> (Queue Out=w5, Error out=w4)
        w6 = default
      }
      on "Prechck Cell" Value changed {
        Event Data() -> ("New Value"=w39)
        Not(x=w39) -> w40
        Property Node(instance in=reference to "Dead Current Threshold", "Disabled"=w40, error in=s1) -> (error out=w4)
        w5 = w1
        w6 = default
      }
    }
    call "Error Detected STOP subroutine.gvi"(Input=w5, Input_2=w6, Input_3=w4) -> (Output=w41, stop=w42, Output_2=w43)
    next s1 = w43
    stop if w42
  }
  s2 = w3  # shift register
  while {
    Dequeue Element(error in=s2, queue=w1) -> (element=w44, error out=w45, queue out=w46)
    case (w45) {
      frame Error, Default {
        call "Current State FGV.gvi"(Instruction Current State FGV="Set current State", Crrent State="Stop App")
        w47 = w45
        w48 = TRUE
        w49 = default
      }
      frame No Error {
        case (w44) {
          frame "Initialize App" {
            Enqueue Element(element="Instrument detection", error in=w45, queue=w46) -> (error out=w50, queue out=w49)
            call "Enum reset instructions argument extract.gvi"(Reset instructions="Reset Global Variables", Error In=w50) -> (Reset instruction Items=w51, Error Out=w52)
            for {
              w53 = each element of w51
              case (w53) {
                frame "Reset disabled controls", Default {
                  Property Node(instance in="Reset Disabled Controls Cluster.gtype" {all zero or empty}, "Custom date"=$"Custom date", "Autorange "=$Autorange, "Dead Current Threshold Reference"=reference to "Dead Current Threshold", "Manual Range Reference"=reference to "Manual Range", "Dark Current Averages Reference"=reference to "Dark Current Averages", "Current Date Reference"=reference to "Current Date", "Manual Current Range Reference"=reference to "Manual Current Range", "Skip To Next Cell Reference"=reference to "Skip to Next Cell", "Z position Reference"=reference to "Z position", "Keithley Disable Output Reference"=reference to "Keithley Disable Output", "X position Reference"=reference to "X position") -> (instance out=w54)
                  call "Reset Disabled Controls Subroutine.gvi"(Reset Disabled Controls Cluster=w54, Error In=w52) -> (Error Out=w47)
                }
                frame "Reset Global Variables" {
                  call "Global Abort.gvi"(Instruction="Reset Abort", Error In=w52) -> (Error Out=w55)
                  call "Arduino Homed FGV.gvi"(Arduino Homed FGV="Reset to not Homed", Error In=w55) -> (Error Out=w56)
                  call "Skip To next Cell FGV.gvi"(General instruction FGV enum="Reset State", Error In=w56) -> (Error Out=w47)
                }
                frame "Reset doubles" {
                  $"Z scan Range (mm)" <- 4
                  $"X scan Range (mm)" <- 5
                  $"Start Wavelength (nm)" <- 400
                  $"Max current" <- 0.1
                  $"Current (A)" <- 0
                  $"Current Wavelength (nm)" <- 0
                  $"EQE (%)" <- 0
                  $"Progress counter" <- 0
                  $"Wavelength (nm)" <- 0
                  $"Voltage Applied (V)" <- 0
                  $"Current λ (nm)" <- 0
                  $"Progress %" <- 0
                  $"Light Power (W)" <- 0
                  $"Dark Current (A)" <- 0
                  $"Z scan steps" <- 6
                  $"Dark Current Averages" <- 30
                  $"Dead Current Threshold" <- 1e-11
                  $"End Wavelength (nm)" <- 1100
                  $"Current Averages" <- 1
                  $"X scan steps" <- 8
                  $"Wavelength Step (nm)" <- 1
                  $"Manual Current Range" <- 1e-05
                  w47 = w52
                }
                frame "Reset Strings" {
                  $"Batch Name" <- ""
                  $"Sample Comments" <- ""
                  $"Author Initials" <- ""
                  $"Sample Prefix" <- ""
                  $"Cell Measuring Order" <- ""
                  $"Cell Number" <- ""
                  Select(s=FALSE, t="I'm missing The Batch name and the authors initials.", f="I'm missing The Batch name and the authors initials.") -> w57
                  $"Label Info Error Label" <- w57
                  w47 = w52
                }
                frame "Reset Booleans" {
                  $All <- FALSE
                  $"Monochromator Status" <- FALSE
                  $"Multiplexer Arduino Status" <- FALSE
                  $"Random Cell Order" <- FALSE
                  $"Photodetector Status" <- FALSE
                  $"Carriage Arduino Status" <- FALSE
                  $Monochromator <- FALSE
                  $"Custom Position" <- FALSE
                  $"Supercontinuum Status" <- FALSE
                  $"Keythley Status" <- FALSE
                  $"R.01 Scan?" <- FALSE
                  $"Save R.01 Coordinate?" <- FALSE
                  $"Abort All" <- FALSE
                  $"Dark Current" <- TRUE
                  $Autorange <- TRUE
                  $"Prechck Cell" <- TRUE
                  $"Label Info Missing Error" <- TRUE
                  $Autorange <- TRUE
                  w47 = w52
                }
                frame "Reset arrays" {
                  $"Automatic EQE Measurement Graph" <- cluster{"Element 1": f64[], "Element 2": f64[]}[] []
                  $"Light Power Calibration Data" <- f64[][] []
                  $"Cell Measuring Labels" <- string[] []
                  $"Full EQE Data" <- f64[][] []
                  w47 = w52
                }
                frame "Reset Clusters" {
                  Property Node(instance in="Cell Data Cluster 2.gtype" {all zero or empty}) -> (instance out=w58)
                  $"Cell Data Cluster" <- w58
                  w59 = cluster{"Element 1": f64[], "Element 2": f64[]} {all zero or empty}
                  Property Node(instance in=w59) -> (instance out=w60)
                  $"Light Calibration" <- w60
                  Property Node(instance in="Automatic Measurement Indicators.gtype" {all zero or empty}) -> (instance out=w61)
                  $"Automatic Measurement Indicators" <- w61
                  w62 = cluster{"Element 1": f64[], "Element 2": f64[]} {all zero or empty}
                  Property Node(instance in=w62) -> (instance out=w63)
                  $"EQE Measurement" <- w63
                  w47 = w52
                }
                frame "Reset Current Date" {
                  Get Current Time() -> (current time=w64)
                  Get Date And Time String(time stamp=w64) -> (date string=w65)
                  call "Search and Replace Pattern.gvi"(string=w65, pattern="/", replace all=TRUE) -> (result string=w66)
                  Replace Substring(length (len. of substring)=2, offset=5, string=w66) -> (result string=w67)
                  $"Current Date" <- w67
                  w47 = w52
                }
                frame "Reset Fiannium Config file" {
                  call "Check Monochromator Config File.gvi"(Visible infrared="Visible monochromator file", error out=w52) -> (Fiannium Config file path=w68, error in=w69)
                  $"Monochromator configuration file" <- w68
                  call "Check Monochromator Config File.gvi"(Visible infrared="Infrared monochromator file", error out=w69) -> (Fiannium Config file path=w70, error in=w71)
                  call "Check Reference coordinate file.gvi"(R.01 Reference Coordinates=$"R.01 Reference Coordinates", error out=w71) -> (Coordinate reference path=w72, R.01 Reference Coordinates Out=w73, error in=w47)
                  $"Reference Coordinates file" <- w72
                  $"Monochromator configuration file visible" <- w68
                  $"Monochromator configuration file infrared" <- w70
                  $"R.01 Reference Coordinates" <- w73
                }
              }
            }
            w48 = default
          }
          frame "Light Calibration" {
            call "Light Calibration Initialization Sequence.gvi"(Input=w45) -> (Output=w74, Output_2=w75)
            To Unsigned 16 Bit Integer(number=$"Powermeter Averages") -> w76
            w77 = "Light Calibration Input Parameters.gtype" {all zero or empty}
            Property Node(instance in=w77, "Notifier Input"=w74, "Wavelength Step (nm)"=$"Wavelength Step (nm)", "End Wavelength (nm)"=$"End Wavelength (nm)", "Start Wavelength (nm)"=$"Start Wavelength (nm)", "Filter Arduino Status"=$"Filter Arduino Status", "Arduino Filter Flipper Address"=$"Filter Arduino Address", "Monochromator"=$Monochromator, "Powermeter Averages"=w76, "Configuration File"=$"Monochromator configuration file") -> (instance out=w78)
            call "Light calibration.gvi"(Light Calibration Input Parameters=w78, Error In=w75) -> (Light Power Calibration Data=w79, Notifier Output=w80, Error Out=w81)
            $"Light Power Calibration Data" <- w79
            s3 = f64[][] []  # shift register
            while {
              Wait On Notification(error in (no error)=w75, notifier=w74, timeout in milliseconds=10000) -> (error out=w82, notification=w83)
              call "Light Calibration Notification Handler.gvi"(Input=s3, notification=w83) -> (Output=w84, Current λ (nm)=w85, Light Calibration=w86, Light Power (W)=w87, stop=w88)
              $"Current Wavelength (nm)" <- w85
              $"Current λ (nm)" <- w85
              $"Light Power (W)" <- w87
              $"Light Calibration" <- w86
              next s3 = w84
              stop if w88
            }
            call "Light Calibration Closing Subroutine.gvi"(Queue In=w46, Notifier Output=w80, Error In 1=w82, Error In 2=w81) -> (Queue Out=w49, Error Out=w47)
            $"End Wavelength (nm) Current Calibration" <- $"End Wavelength (nm)"
            $"Start Wavelength (nm) Current Calibration" <- $"Start Wavelength (nm)"
            $"Wavelength Step (nm) Current Calibration" <- $"Wavelength Step (nm)"
            call "Graph Adapter.gvi"(Input XY data=w79) -> (Output Graph=w89)
            $"Light Calibration" <- w89
            w48 = default
          }
          frame "Stop App" {
            $"Abort All" <- TRUE
            call "Current State FGV.gvi"(Instruction Current State FGV="Set current State", Crrent State="Stop App", Error In=w45) -> (Error Out=w47)
            w48 = TRUE
            w49 = w46
          }
          frame "Idle", Default {
            call "Global Abort.gvi"(Instruction="Reset Abort", Error In=w45) -> (Error Out=w90)
            call "Current State FGV.gvi"(Instruction Current State FGV="Set current State", Crrent State="Idle", Error In=w90) -> (Error Out=w91)
            call "Current State FGV.gvi"(Instruction Current State FGV="Set Current SubState", Current SubState="Not specified", Error In=w91) -> (Error Out=w47)
            w48 = default
            w49 = w46
          }
          frame "Instrument detection" {
            # Detect that we have all the needed instruments connected and prompt the user if any instrument is missing.
            # Ask them if they want to continue anyway and disable all the features that cannot be performed without that instrument.
            call "Current State FGV.gvi"(Instruction Current State FGV="Set current State", Crrent State="Instrument detection", Error In=w45) -> (Error Out=w92)
            call "Instrument Detection Sequence.gvi"(Monochromator configuration file visible=$"Monochromator configuration file visible", Monochromator configuration file infrared=$"Monochromator configuration file infrared", Error In=w92) -> (Ir Monochromator?=w93, Instrument Detection Sequence control=w94, Error Out=w95)
            Property Node(instance in=w94) -> ("Photodetector Status"=w96, "Photodetector Names"=w97, "Keythley Status"=w98, "Keithley Address"=w99, "Monochromator Status"=w100, "Monochromator Name"=w101, "Multiplexer Arduino Status"=w102, "Multiplexer Arduino Address"=w103, "Carriage Arduino Status"=w104, "Carriage Arduino Address"=w105, "Filter Arduino Status"=w106, "Filter Arduino Address"=w107, "Supercontinuum Status"=w108, "Supercontinuum laser Address"=w109)
            $"Photodetector Status" <- w96
            $"Monochromator Name" <- w101
            $"Multiplexer Arduino Status" <- w102
            call "Wavelength Coercer.gvi"(Start Wavelength (nm)=$"Start Wavelength (nm)", End Wavelength (nm)=$"End Wavelength (nm)", Error In=w95, Monochromator=w93) -> (Start Wavelength (nm) out=w110, End Wavelength (nm) out=w111, Error Out=w112)
            call "Laser power extractor.gvi"(Supercontinuum laser Address=w109, Error Out_2=w112) -> (Laser Status=w113, Laser Current Power=w114, error in=w115)
            $"Laser Status" <- w113
            # Still missing carriage arduino and multiplexer arduino
            Enqueue Element(element="Idle", error in=w115, queue=w46) -> (error out=w47, queue out=w49)
            $"Laser Current Power" <- w114
            $"Start Wavelength (nm)" <- w110
            Select(s=w93, t=1100, f=500) -> w116
            $"Desired λ (nm)" <- w116
            $Monochromator <- w93
            Select(s=w93, t=$"Monochromator configuration file infrared", f=$"Monochromator configuration file visible") -> w117
            $"Monochromator configuration file" <- w117
            $"Photodetector Names" <- w97
            $"Multiplexer Arduino Address" <- w103
            $"Carriage Arduino Status" <- w104
            $"Keythley Status" <- w98
            $"Carriage Arduino Address" <- w105
            $"Filter Arduino Status" <- w106
            $"Keithley Address" <- w99
            $"Monochromator Status" <- w100
            $"Filter Arduino Address" <- w107
            $"Supercontinuum Status" <- w108
            $"Supercontinuum laser Address" <- w109
            $"End Wavelength (nm)" <- w111
            w48 = default
          }
          frame "Turn supercontinuum laser on/off" {
            call "Current State FGV.gvi"(Instruction Current State FGV="Set current State", Crrent State="Turn supercontinuum laser on/off", Error In=w45) -> (Error Out=w118)
            case ($"Laser Status") {
              frame False, Default {
                call "Supercontinuum Shut Down Sequence.gvi"(Supercontinuum laser Address=$"Supercontinuum laser Address", Error In=w118) -> (Successful Shutdown?=w122, Error Out=w120)
                Not(x=w122) -> w121
                w119 = w46
              }
              frame True {
                call "Supercontinuum Warm Up Sequence.gvi"(Supercontinuum laser Address=$"Supercontinuum laser Address", Error In=w118) -> (Successful Warmup?=w121, Error Out=w120)
                w119 = w46
              }
            }
            Enqueue Element(element="Idle", error in=w120, queue=w119) -> (error out=w47, queue out=w49)
            $"Laser Status" <- w121
            w48 = default
          }
          frame "Save Calibration" {
            call "Current State FGV.gvi"(Instruction Current State FGV="Set current State", Crrent State="Save Calibration", Error In=w45) -> (Error Out=w123)
            call "Save Calibration File.gvi"(Default Data Saving Location=$"Default Data Saving Location", Light Power Calibration Data=$"Light Power Calibration Data", Author Initials=$"Author Initials", Sample Prefix=$"Sample Prefix", Current Date=$"Current Date", Batch Name=$"Batch Name", Error In=w123) -> (Folder to save all data=w124, Error Out=w125)
            $"Default Data Saving Location" <- w124
            Enqueue Element(element="Idle", error in=w125, queue=w46) -> (error out=w47, queue out=w49)
            w48 = default
          }
          frame "Load Calibration" {
            call "Current State FGV.gvi"(Instruction Current State FGV="Set current State", Crrent State="Load Calibration", Error In=w45) -> (Error Out=w126)
            call "Load Calibration file.gvi"(Light calibration data In=$"Light Power Calibration Data", Error In=w126) -> (End Wavelength (nm) Current Calibration=w127, Wavelength Step (nm) Current Calibration=w128, Start Wavelength (nm) Current Calibration=w129, Light Power Calibration Data Out=w130, Light Calibration=w131, Error Out=w132)
            $"End Wavelength (nm)" <- w127
            $"End Wavelength (nm) Current Calibration" <- w127
            $"Start Wavelength (nm)" <- w129
            $"Start Wavelength (nm) Current Calibration" <- w129
            Enqueue Element(element="Idle", error in=w132, queue=w46) -> (error out=w47, queue out=w49)
            $"Light Power Calibration Data" <- w130
            $"Light Calibration" <- w131
            $"Wavelength Step (nm) Current Calibration" <- w128
            $"Wavelength Step (nm)" <- w128
            w48 = default
          }
          frame "Single Acquire" {
            call "Current State FGV.gvi"(Instruction Current State FGV="Set current State", Crrent State="Single Acquire", Error In=w45) -> (Error Out=w133)
            w134 = "Single Acquire Notification control.gtype" {all zero or empty}
            Obtain Notifier(element data type=w134, error in=w133, name="Wavelength EQE and current (and done)") -> (error out=w135, notifier out=w136)
            s4 = f64[][] []  # shift register
            while {
              call "Global Abort.gvi"(Instruction="Read Abort State", Error In=w135) -> (Local Abort State=w137, Global Abort State=w138, Error Out=w139)
              Wait On Notification(error in (no error)=w139, notifier=w136, timeout in milliseconds=1000) -> (error out=w140, notification=w141, notifier out=w142, timed out?=w143)
              case (w143) {
                frame True {
                  w144 = s4
                  w145 = FALSE
                }
                frame False {
                  Property Node(instance in=w141) -> ("Wavelength (nm)"=w146, "EQE (%)"=w147, "Current (A)"=w148, "Finnished"=w145, "Progress"=w149)
                  $"Wavelength (nm)" <- w146
                  $"Current λ (nm)" <- w146
                  Build Array(w146, w147) -> w150
                  Build Array(s4, w150) -> w144
                  call "Graph Adapter.gvi"(Input XY data=w144) -> (Output Graph=w151)
                  $"EQE Measurement" <- w151
                  $"EQE (%)" <- w147
                  $"Current (A)" <- w148
                  $"Progress %" <- w149
                }
              }
              Logical Or(w145, w137, w138) -> w152
              next s4 = w144
              stop if w152
            }
            To Signed 32 Bit Integer(number=$"Current Averages") -> w153
            Property Node(instance in="Single acquire inputs control.gtype" {all zero or empty}, "Light calibration data"=$"Light Power Calibration Data", "Fiannium Configuration File"=$"Monochromator configuration file", "Arduino Filter Flipper Address"=$"Filter Arduino Address", "Filter Arduino Status"=$"Filter Arduino Status", "Dark Current Averages"=$"Dark Current Averages", "Measure dark current?"=$"Dark Current", "Keithley Address"=$"Keithley Address", "Current Aveages"=w153, "Voltage Applied (V)"=$"Voltage Applied (V)", "Max current compliance"=$"Max current", "Manual Current Range"=$"Manual Current Range", "Enable Auto Range"=$Autorange, "Automatic measurement"=FALSE, "Monocrhomator"=$Monochromator) -> (instance out=w154)
            call "Single EQE Measurement Acquire.gvi"(Single acquire inputs control=w154, Notifier In=w136, Error In=w135) -> (Full EQE Data=w155, Dark Current=w156, Error Out=w157)
            call "Single Acquire Close Subroutine.gvi"(Input=w46, Input_2=w142, Input_3=w157, Error Out_2=w140) -> (Output=w49, Output_2=w47)
            $"Full EQE Data" <- w155
            $"Dark Current (A)" <- w156
            w48 = default
          }
          frame "Set Wavelength" {
            call "Set Desired Wavelength Slave Subroutine.gvi"(Queue In=w46, Monochromator configuration file=$"Monochromator configuration file", Desired λ (nm)=$"Desired λ (nm)", Error In=w45, Monochromator=$Monochromator) -> (Queue Out=w49, Error Out=w47)
            $"Current λ (nm)" <- $"Desired λ (nm)"
            w48 = default
          }
          frame "Set Multiplex arduino cell" {
            call "Current State FGV.gvi"(Instruction Current State FGV="Set current State", Crrent State="Set Multiplex arduino cell", Error In=w45) -> (Error Out=w158)
            Format Into String(errIn=w158, $"Desired Cell") -> (outString=w159, errOut=w160)
            call "Multiplexer Arduino Control.gvi"(Arduino Multiplexer Address In=$"Multiplexer Arduino Address", Cell Label=w159, Error In=w160) -> (Arduino Multiplexer Log=w161, Error Out=w162)
            Enqueue Element(element="Idle", error in=w162, queue=w46) -> (error out=w47, queue out=w49)
            $"Arduino Multiplexer Log." <- w161
            w48 = default
          }
          frame "Arduino FF flip filter" {
            call "Current State FGV.gvi"(Instruction Current State FGV="Set current State", Crrent State="Arduino FF flip filter", Error In=w45) -> (Error Out=w163)
            call "Arduino filter FGV current state.gvi"(Arduino Filter Flipper FGV instructions="Read State", Error In=w163) -> (Flipper State Boolean=w164, Error Out=w165)
            Select(s=w164, t="Visible Pass", f="IR Pass") -> w166
            call "Arduino Filter Flipper Control.gvi"(Arduino Filter Flipper Address In=$"Filter Arduino Address", Pass Filter=w166, Error In=w165) -> (Filter Flipper Log=w167, Error Out=w168)
            call "Arduino filter FGV current state.gvi"(Arduino Filter Flipper FGV instructions="Set State", Arduino Filter Flipper Instructions In=w166, Error In=w168) -> (Error Out=w169)
            Enqueue Element(element="Idle", error in=w169, queue=w46) -> (error out=w47, queue out=w49)
            $"Filter Flipper Log" <- w167
            w48 = default
          }
          frame "Save TXT EQE file" {
            call "Current State FGV.gvi"(Instruction Current State FGV="Set current State", Crrent State="Save TXT EQE file", Error In=w45) -> (Error Out=w170)
            call "Save EQE TXT File.gvi"(Dark Current=$"Dark Current (A)", Dark Current Measured?=$"Dark Current", Default Data Saving Location=$"Default Data Saving Location", Full EQE Data=$"Full EQE Data", Author Initials=$"Author Initials", Sample Prefix=$"Sample Prefix", Current Date=$"Current Date", Batch Name=$"Batch Name", Error In=w170, Path type="Single EQE") -> (Folder to save all data=w171, Error Out=w172)
            $"Default Data Saving Location" <- w171
            Enqueue Element(element="Idle", error in=w172, queue=w46) -> (error out=w47, queue out=w49)
            w48 = default
          }
          frame "Multiple Acquire" {
            call "Multiple Acquire initialize.gvi"(Skip to next cell reference=reference to "Skip to Next Cell", Error In=w45) -> (Error Out=w173)
            w174 = "Multiple aquire notification constant.gtype" {all zero or empty}
            Obtain Notifier(element data type=w174, error in=w173, name="Multiple EQE measurement Main Window") -> (error out=w175, notifier out=w176)
            s5 = w176  # shift register
            s6 = "Automatic Measurement Indicators.gtype" {all zero or empty}  # shift register
            s7 = cluster{"Element 1": f64[], "Element 2": f64[]}[] []  # shift register
            while {
              call "Global Abort.gvi"(Instruction="Read Abort State", Error In=w175) -> (Local Abort State=w177, Global Abort State=w178, Error Out=w179)
              Wait On Notification(error in (no error)=w179, notifier=s5, timeout in milliseconds=1000) -> (error out=w180, notification=w181, timed out?=w182)
              call "Multiple Acquire Notification Handler.gvi"(Input=s7, Notification Cluster Single=s6, Notification Cluster Multiple=w181, timed out?=w182, Current λ (nm) In=$"Current λ (nm)", Progress % In=$"Progress %", Error In_2=w180) -> (Automatic EQE Measurement Graph Out=w183, Automatic Measurement Indicators In=w184, Current λ (nm)=w185, Progress % Out=w186, Finished?=w187, Error In=w188)
              $"Automatic EQE Measurement Graph" <- w183
              $"Current λ (nm)" <- w185
              $"Automatic EQE Measurement Data" <- w183
              $"Progress %" <- w186
              $"Progress counter" <- w186
              call "Automatic Measurement Graph Postprocessor.gvi"(Automatic EQE Measurement Graph Reference=reference to "Automatic EQE Measurement Graph", Automatic Measurement Indicators In=w184, Cell Measuring Labels=$"Cell Measuring Labels", Error In=w188) -> (Automatic Measurement Indicators=w189, Error Out=w190)
              $"Automatic Measurement Indicators" <- w189
              Logical Or(w187, w177, w178) -> w191
              next s6 = w184
              next s7 = w183
              stop if w191
            }
            w192 = "Multiple acquire variables control.gtype" {all zero or empty}
            Property Node(instance in=w192, "Monochromator configuration file "=$"Monochromator configuration file", "Light Power Calibration Data"=$"Light Power Calibration Data", "Cell Measuring Labels"=$"Cell Measuring Labels", "Sample Prefix"=$"Sample Prefix", "Author Initials"=$"Author Initials", "Current Date"=$"Current Date", "Batch Name"=$"Batch Name", "Default Data Saving Location"=$"Default Data Saving Location", "Filter Arduino Status"=$"Filter Arduino Status", "Filter Arduino Address"=$"Filter Arduino Address", "Multiplexer Arduino Address"=$"Multiplexer Arduino Address", "R.01 Reference Coordinates"=$"R.01 Reference Coordinates", "Carriage Arduino Address"=$"Carriage Arduino Address", "Keithley Address"=$"Keithley Address", "Current Averages   "=$"Current Averages", "Manual Range  "=$"Manual Range", "Max current"=$"Max current", "Voltage Applied (V)  "=$"Voltage Applied (V)", "Autorange  "=$Autorange, "Dark Current  "=$"Dark Current", "Wavelength for peak detection"=$"Wavelength for peak detection", "R.01 Scan?"=$"R.01 Scan?", "Z scan steps"=$"Z scan steps", "X scan Range (mm)"=$"X scan Range (mm)", "Z scan Range (mm)"=$"Z scan Range (mm)", "X scan steps"=$"X scan steps", "Reference Coordinates file"=$"Reference Coordinates file", "Save R.01 Coordinate?"=$"Save R.01 Coordinate?", "Automatic Measurement?"=TRUE, "Dead Cell 10mV Current Threshold"=$"Dead Current Threshold", "Monochromator"=$Monochromator) -> (instance out=w193)
            call "Dead Cell Check.gvi"(Precheck Cells=$"Prechck Cell", multiple acquire variables control out=w193, Cell Measuring Order=$"Cell Measuring Order", error out_2=w175) -> (Multiple acquire variable Control=w194, Cell Measuring Order_2=w195, Error In=w196)
            call "Multiple acuire precheck cells.gvi"(Multiple acquire variable Control=w194, Error In=w196) -> (Multiple acquire variables control Out=w197, Error Out=w198)
            call "Multiple Aquire Sequence.gvi"(Multiple acquire variables control=w197, Notifier In=w176, Error In=w198) -> (XZ Scan Intensity Graph=w199, XZ Carriage Arduino Log=w200, Arduino Multiplexer Log=w201, Error Out=w202)
            call "Multiple Acquire Graph update and close.gvi"(Queue In=w46, Notification Reference In=s5, Skip To Next Cell Reference=reference to "Skip to Next Cell", Automatic Measurement Indicators In 2=s6, Automatic EQE Measurement Data 2=s7, Automatic Measurement Indicators In 1=$"Automatic Measurement Indicators", Automatic EQE Measurement Data 1=$"Automatic EQE Measurement Data", Error In 1=w202, Error In 2=w190) -> (Queue Out=w49, Automatic Measurement Indicators Out=w203, Automatic EQE Measurement Graph Out=w204, Automatic EQE Measurement Data Out=w205, Error Out=w47)
            $"Automatic Measurement Indicators" <- w203
            $"Automatic EQE Measurement Data" <- w205
            $"Automatic EQE Measurement Graph" <- w204
            $"Cell Measuring Order" <- w195
            $"XZ Scan Intensity Graph" <- w199
            $"XZ Carriage Arduino Log" <- w200
            $"Arduino Multiplexer Log" <- w201
            w48 = default
          }
          frame "Move Arduino" {
            call "Current State FGV.gvi"(Instruction Current State FGV="Set current State", Crrent State="Move Arduino", Error In=w45) -> (Error Out=w206)
            call "Move Arduino Initialize Subroutine.gvi"(Carriage Arduino Address=$"Carriage Arduino Address", XZ Carriage Arduino Log=$"XZ Carriage Arduino Log", Carriage Active=$"Carriage Active", Error Out_2=w206) -> (XZ Carriage Arduino Open Visa Session In=w207, XZ Carriage Arduino Log In=w208, XZ Carriage Arduino Log_2=w209, Carriage Active_2=w210, Error In=w211)
            call "XZ Carriage Arduino Homing Sequence.gvi"(XZ Carriage Arduino Open Visa Session In=w207, XZ Carriage Arduino Log In=w208, Error In=w211) -> (XZ Carriage Arduino Open Visa Session Out=w212, XZ Carriage Arduino Log Out=w213, Error Out=w214)
            s8 = 0  # shift register
            while {
              case ($"Set Postion") {
                frame False, Default {
                  Increment(x=s8) -> w218
                  w215 = w212
                  w216 = w213
                  w217 = w214
                }
                frame True {
                  case ($"Custom Position") {
                    frame False, Default {
                      Format Into String($"Cell Label") -> w221
                      call "XZ Carriage Label to Coordinate.gvi"(Cell Label=w221, R.01 Reference Coordinates=$"R.01 Reference Coordinates", Error In=w214) -> (Gcode Instruction Out=w219, Error Out=w220)
                    }
                    frame True {
                      call "XZ Coordinate to Gcode command.gvi"(X position=$"X position", Z position=$"Z position") -> (Input Command=w219)
                      w220 = w214
                    }
                  }
                  call "XZ Carriage Arduino Move to location.gvi"(XZ Carriage Arduino open Visa session In=w212, XZ Carriage Arduino Log In=w213, Input Command=w219, Error In=w220) -> (XZ Carriage Arduino open Visa Session Out=w215, XZ Carriage Arduino Log Out=w216, Error Out=w217)
                  w218 = 0
                }
              }
              $"XZ Carriage Arduino Log" <- w216
              Is Greater(x=w218, y=120) -> w222
              call "Global Abort.gvi"(Instruction="Read Abort State") -> (Local Abort State=w223, Global Abort State=w224)
              Logical Or(w222, $"Release Arduino", w223, w224) -> w225
              Wait Until Next Multiple(multiple to wait=500)
              next s8 = w218
              stop if w225
            }
            call "Move Arduino Close Subroutine.gvi"(Input=w46, Input_2=w215, Input_3=w217) -> (Output=w49, Carriage Active=w226, Output_2=w47)
            $"Carriage Active" <- w226
            $"XZ Carriage Arduino Log" <- w209
            $"Carriage Active" <- w210
            w48 = default
          }
          frame "Measure Keithley" {
            call "Current State FGV.gvi"(Instruction Current State FGV="Set current State", Crrent State="Move Arduino", Error In=w45) -> (Error Out=w227)
            Property Node(instance in=reference to "Keithley Disable Output", "Disabled"=FALSE, error in=w227) -> (error out=w228)
            Property Node(instance in=reference to "Keithley Enable Output", "Disabled"=TRUE, error in=w228) -> (error out=w229)
            call "Keithley Initialization Sequence.gvi"(Enable Auto Range=$"Enable Auto Range", VISA resource name=$"Keithley Address", Voltage Applied (V)=$"Voltage Applied (V).", Source Limit Level (0.1)=$"Source Limit Level.", Current Averages=$"Current Averages.", Error In=w229, Manual Current Range=$"Manual Current Range.") -> (VISA resource name out=w230, Error Out=w231)
            call "Enable Output.gvi"(VISA resource name=w230, Enable Output (T: Enable)=TRUE, error in (no error)=w231) -> (VISA resource name out=w232, error out=w233)
            s9 = w233  # shift register
            s10 = w232  # shift register
            while (iteration -> i1) {
              call "Make Reading and Store in Buffer.gvi"(VISA resource name=s10, error in (no error)=s9) -> (VISA resource name out=w234, error out=w235)
              call "Read (Single Point).gvi"(VISA resource name=w234, error in (no error)=w235) -> (VISA resource name out=w236, Data out=w237, error out=w238)
              $"Keithley Current Measurement" <- w237
              Is Greater(x=i1, y=600) -> w239
              Logical Or(w239, $"Keithley Disable Output") -> w240
              Wait Until Next Multiple(multiple to wait=200)
              next s9 = w238
              next s10 = w236
              stop if w240
            }
            call "Enable Output.gvi"(VISA resource name=s10, Enable Output (T: Enable)=FALSE, error in (no error)=s9) -> (VISA resource name out=w241, error out=w242)
            call "Close.gvi"(VISA resource name=w241, error in (no error)=w242) -> (error out=w243)
            Property Node(instance in=reference to "Keithley Disable Output", "Disabled"=TRUE, error in=w243) -> (error out=w244)
            Property Node(instance in=reference to "Keithley Enable Output", "Disabled"=FALSE, error in=w244) -> (error out=w245)
            Enqueue Element(element="Idle", error in=w245, queue=w46) -> (error out=w47, queue out=w49)
            w48 = default
          }
        }
      }
    }
    next s2 = w47
    stop if w48
  }
  call "Terminate Queue.gvi"(Input_3=w41, selector=TRUE, Input=s1, Input_2=s2) -> (Error Out=w246)
  $"Error Out" <- w246
