vi "Arduino Detector.gvi"   [LabVIEW NXG 3.1.0]
inputs:
  "Error In": error
outputs:
  "Arduinos List": T1[]
  "Carriage Arduino Detected?": bool
  "Carriage Arduino Address": "VISA Instr"
  "Multiplexer Arduino Detected?": bool
  "Multiplexer Arduino Address": "VISA Instr"
  "Filter Arduino Detected?": bool
  "Filter Arduino Address": "VISA Instr"
  "Error Out": error
panel indicators:
  "found resources": string[]
types:
  T1 = cluster{"Element 1": "VISA Instr", "Element 2": string}
uses:
  NI::VISA::Find Resource (Search Resources).gvi
  EQE_Measuring_Setup_NanOpto::SubVis::FGV::Current State FGV.gvi
  NI::VISA::Open (Instr).gvi
  NI::VISA::Read (Instr, String).gvi
  NI::VISA::Close (Instr).gvi
  NI::G Core::Error::Clear Error Cluster.gvi
diagram:
  case ($"Error In") {
    frame Error, Default {
      w1 = $"Error In"
    }
    frame No Error {
      call "Find Resource (Search Resources).gvi"() -> (found resources=w2)
      $"found resources" <- w2
      call "Current State FGV.gvi"(Instruction Current State FGV="Set Current SubState", Current SubState="Detecting Arduinos", Error In=$"Error In") -> (Error Out=w3)
      for {
        w4 = each element of w2
        Search And Replace String(error in (no error)=w3, input string=w4, search string="ASRL") -> (error out=w12, number of replacements=w13)
        Is Not Equal To 0(x=w13) -> w14
        case (w14) {
          frame False, Default {
            w15 = w12
            w16 = ""
            w17 = ""
          }
          frame True {
            call "Open (Instr).gvi"(resource name=w4, error in=w12, open timeout=300) -> (session out=w18, error out=w19)
            call "Read (Instr, String).gvi"(session in=w18, error in=w19, byte count=50) -> (session out=w17, error out=w20, read buffer=w16)
            call "Close (Instr).gvi"(session in=w17, error in=w20) -> (error out=w21)
            call "Clear Error Cluster.gvi"(error in=w21) -> (error out=w15)
          }
        }
        Build Cluster(w17, w16) -> w22
        Search And Replace String(error in (no error)=w15, input string=w16, search string="Arduin") -> (error out=w23, number of replacements=w24)
        Search And Replace String(error in (no error)=w23, input string=w16, search string="XZ Stage") -> (error out=w25, number of replacements=w26)
        Search And Replace String(error in (no error)=w25, input string=w16, search string="Multiplex") -> (error out=w27, number of replacements=w28)
        Search And Replace String(error in (no error)=w27, input string=w16, search string="Filter") -> (error out=w1, number of replacements=w29)
        Is Not Equal To 0(x=w29) -> w30
        Is Not Equal To 0(x=w24) -> w31
        Logical And(w31, w14) -> w32
        Is Not Equal To 0(x=w26) -> w33
        Is Not Equal To 0(x=w28) -> w34
        append w22 to w5 if w32
        append w33 to w6
        append w34 to w7
        append w30 to w8
        w9 = w17 if w33
        w10 = w17 if w34
        w11 = w17 if w30
      }
      Or Array Elements(Boolean array=w8) -> (logical OR=w35)
      $"Filter Arduino Detected?" <- w35
      $"Filter Arduino Address" <- w11
      $"Arduinos List" <- w5
      Or Array Elements(Boolean array=w6) -> (logical OR=w36)
      $"Carriage Arduino Detected?" <- w36
      $"Carriage Arduino Address" <- w9
      $"Multiplexer Arduino Address" <- w10
      Or Array Elements(Boolean array=w7) -> (logical OR=w37)
      $"Multiplexer Arduino Detected?" <- w37
    }
  }
  $"Error Out" <- w1
