vi "Keithley measure single point.gvi"   [LabVIEW NXG 3.1.0]
inputs:
  "Keithley Address In": "VISA Instr"
  "Error In": error
outputs:
  "Keithley address out": "VISA Instr"
  "Data": string
  "Error Out": error
uses:
  Keithley 2450 NXG Library::Public::Action Status::Enable Output.gvi
  Keithley 2450 NXG Library::Public::Data::Make Reading and Store in Buffer.gvi
  Keithley 2450 NXG Library::Public::Data::Read (Single Point).gvi
diagram:
  call "Enable Output.gvi"(VISA resource name=$"Keithley Address In", Enable Output (T: Enable)=TRUE, error in (no error)=$"Error In") -> (VISA resource name out=w1, error out=w2)
  call "Make Reading and Store in Buffer.gvi"(VISA resource name=w1, error in (no error)=w2) -> (VISA resource name out=w3, error out=w4)
  call "Read (Single Point).gvi"(VISA resource name=w3, error in (no error)=w4) -> (VISA resource name out=w5, Data out=w6, error out=w7)
  $Data <- w6
  call "Enable Output.gvi"(VISA resource name=w5, Enable Output (T: Enable)=FALSE, error in (no error)=w7) -> (VISA resource name out=w8, error out=w9)
  $"Keithley address out" <- w8
  $"Error Out" <- w9
