vi "Dark current Measurement.gvi"   [LabVIEW NXG 3.1.0]
inputs:
  "Keithley Address": "VISA Instr"
  "Fiannium Pe Handler": u64
  "Close Coms after finish?": bool
  "Dark Current Aveages": i32 = 3
  "Error In": error
outputs:
  "Pe Handle out": u64
  "Dark current Value": f64
  "Error Out": error
  "Keythley address out": "VISA Instr"
panel indicators:
  "Dark current measurements": f64[]
uses:
  Keithley 2450 NXG Library::Public::Configure::Set Measurement Count.gvi
  Keithley 2450 NXG Library::Public::Configure::Clear Buffer.gvi
  Keithley 2450 NXG Library::Public::Action Status::Enable Output.gvi
  EQE_Measuring_Setup_NanOpto::SubVis::FGV::Current State FGV.gvi
  EQE_Measuring_Setup_NanOpto::SubVis::Instrument Control::Monochromator::Fiannium wavelength correction.gvi
  PE_Filter_SDK::PE Set Wavelength On Grating.gvi
  Keithley 2450 NXG Library::Public::Data::Make Reading and Store in Buffer.gvi
  Keithley 2450 NXG Library::Public::Data::Read (Multiple Points).gvi
  NI::Analysis::Statistics::Mean (DBL).gvi
  Keithley 2450 NXG Library::Public::Close.gvi
  PE_Filter_SDK::PE Close.gvi
  PE_Filter_SDK::PE Destroy.gvi
diagram:
  case ($"Error In") {
    frame Error, Default {
      w1 = $"Error In"
    }
    frame No Error {
      call "Set Measurement Count.gvi"(VISA resource name=$"Keithley Address", Measurement Count=$"Dark Current Aveages", error in (no error)=$"Error In") -> (VISA resource name out=w2, error out=w3)
      call "Clear Buffer.gvi"(VISA resource name=w2, error in (no error)=w3) -> (VISA resource name out=w4, error out=w5)
      call "Enable Output.gvi"(VISA resource name=w4, Enable Output (T: Enable)=TRUE, error in (no error)=w5) -> (VISA resource name out=w6, error out=w7)
      call "Current State FGV.gvi"(Instruction Current State FGV="Set Current SubState", Current SubState="Measuring Dark Current", Error In=w7) -> (Error Out=w8)
      call "Fiannium wavelength correction.gvi"(Desired wavelength=350) -> (Grating for the system=w9, Wavelength for the system=w10)
      call "PE Set Wavelength On Grating.gvi"(peHandle=$"Fiannium Pe Handler", gratingIndex=w9, wavelength=w10, error in (no error)=w8) -> (peHandle out=w11, error out=w12)
      call "Make Reading and Store in Buffer.gvi"(VISA resource name=w6, error in (no error)=w12) -> (VISA resource name out=w13, error out=w14)
      call "Read (Multiple Points).gvi"(VISA resource name=w13, Timeout (10000 ms)=60000, Start Index (1)=1, End Index (1)=$"Dark Current Aveages", error in (no error)=w14) -> (VISA resource name out=w15, Data out=w16, error out=w17)
      Spreadsheet String To Array(array type=f64[] [], delimiter=",", format string="%g", spreadsheet string=w16) -> (array=w18)
      $"Dark current measurements" <- w18
      call "Dark current timeout notification.gvi"(error out_2=w17) -> (error in_2=w19)
      call "Mean (DBL).gvi"(x=w18, error in=w19) -> (mean=w20, error out=w21)
      call "Enable Output.gvi"(VISA resource name=w15, Enable Output (T: Enable)=FALSE, error in (no error)=w21) -> (VISA resource name out=w22, error out=w23)
      call "Clear Buffer.gvi"(VISA resource name=w22, error in (no error)=w23) -> (VISA resource name out=w24, error out=w25)
      case ($"Close Coms after finish?") {
        frame False, Default {
          $"Pe Handle out" <- w11
          $"Keythley address out" <- w24
          w1 = w25
        }
        frame True {
          call "Close.gvi"(VISA resource name=w24, error in (no error)=w25) -> (error out=w26)
          call "Fiannium wavelength correction.gvi"(Desired wavelength=550) -> (Grating for the system=w27, Wavelength for the system=w28)
          call "PE Set Wavelength On Grating.gvi"(peHandle=w11, gratingIndex=w27, wavelength=w28, error in (no error)=w26) -> (peHandle out=w29, error out=w30)
          call "PE Close.gvi"(peHandle=w29, error in (no error)=w30) -> (peHandle out=w31, error out=w32)
          call "PE Destroy.gvi"(peHandle=w31, error in (no error)=w32) -> (error out=w1)
        }
      }
      $"Dark current Value" <- w20
    }
  }
  $"Error Out" <- w1
