vi "Fiannium wavelength correction.gvi"   [LabVIEW NXG 3.1.0]
inputs:
  "Desired wavelength": f64
outputs:
  "Wavelength for the system": f64
  "Grating for the system": i64
uses:
  EQE_Measuring_Setup_NanOpto::SubVis::Instrument Control::Monochromator::Grating Change Wavelength.gvi
diagram:
  case (TRUE) {
    frame False, Default {
      w1 = $"Desired wavelength"
      w2 = 0
    }
    frame True {
      Add($"Desired wavelength", 1.3) -> w3
      Subtract(x=$"Desired wavelength", y=4.7) -> w4
      call "Grating Change Wavelength.gvi"() -> (Grating Change Wavelength=w5)
      Is Greater(x=$"Desired wavelength", y=w5) -> w6
      Select(s=w6, t=w3, f=w4) -> w1
      Select(s=w6, t=1, f=0) -> w2
    }
  }
  $"Wavelength for the system" <- w1
  $"Grating for the system" <- w2
