vi "Multiple Acquire Dark current Measurement.gvi"   [LabVIEW NXG 3.1.0]
inputs:
  "Error In": error
  "Multiple acquire variables control": "Multiple acquire variables control.gtype"
  "Multiplexer arduino Log In": string
outputs:
  "Error Out": error
  "All Dark Currents": "Multiple Acquire Dark Current cluster.gtype"
  "Multiplexer arduino log out": string
panel indicators:
  "Dark Current": f64
  "Keythley address out": "VISA Instr"
types:
  "R.01 Reference Coordinates.gtype" = cluster{"X coordinate R.01": f64, "Z coordinate R.01": f64, "Vertical Spacing": f64}
  "Multiple acquire variables control.gtype" = cluster{"Monochromator configuration file ": path, "Light Power Calibration Data": f64[][], "Cell Measuring Labels": string[], "Sample Prefix": string, "Author Initials": string, "Current Date": string, "Batch Name": string, "Default Data Saving Location": path, "Filter Arduino Status": bool, "Filter Arduino Address": "VISA Instr", "Multiplexer Arduino Address": "VISA Instr", "Carriage Arduino Address": "VISA Instr", "Keithley Address": "VISA Instr", "Current Averages   ": f64, "Manual Range  ": f64, "Max current": f64, "Voltage Applied (V)  ": f64, "Autorange  ": bool, "Dark Current  ": bool, "Wavelength for peak detection": f64, "R.01 Reference Coordinates": "R.01 Reference Coordinates.gtype", "R.01 Scan?": bool, "Z scan steps": f64, "X scan Range (mm)": f64, "Z scan Range (mm)": f64, "X scan steps": f64, "Reference Coordinates file": path, "Save R.01 Coordinate?": bool, "Fianium Pe Handler": u64, "Automatic Measurement?": bool, "Dead Cell 10mV Current Threshold": f64, "Precheck cells?": bool}
  T1 = cluster{"Cell Label": string, "Dark Current": f64}
  "Multiple Acquire Dark Current cluster.gtype" = T1[]
uses:
  EQE_Measuring_Setup_NanOpto::SubVis::FGV::Current State FGV.gvi
  EQE_Measuring_Setup_NanOpto::SubVis::Instrument Control::Arduinos::Filter Flipper Arduino::Filter Plipper Arduino set to IR pass.gvi
  EQE_Measuring_Setup_NanOpto::SubVis::Instrument Control::Arduinos::Multiplexer Arduino::Multiplexer Arduino Control.gvi
  EQE_Measuring_Setup_NanOpto::SubVis::Utilities::Other::Wait In line ms.gvi
  EQE_Measuring_Setup_NanOpto::SubVis::Instrument Control::Keithley::Dark current Measurement.gvi
  EQE_Measuring_Setup_NanOpto::SubVis::Main Sub Functions::Global Abort::Global Abort.gvi
  Keithley 2450 NXG Library::Public::Configure::Set Measurement Count.gvi
diagram:
  Property Node(instance in=$"Multiple acquire variables control") -> ("Current Averages   "=w1, "Keithley Address"=w2, "Multiplexer Arduino Address"=w3, "Cell Measuring Labels"=w4, "Filter Arduino Address"=w5, "Filter Arduino Status"=w6, "Current Averages   "=w7, "Fianium Pe Handler"=w8)
  Multiply(w1, 5) -> w9
  case ($"Error In") {
    frame Error, Default {
      w10 = $"Error In"
    }
    frame No Error {
      call "Current State FGV.gvi"(Instruction Current State FGV="Set Current SubState", Current SubState="Measuring Dark Current", Error In=$"Error In") -> (Error Out=w11)
      call "Filter Plipper Arduino set to IR pass.gvi"(Arduino Filter Flipper Address=w5, Filter Arduino Status=w6, Error In=w11) -> (Error Out=w12)
      s1 = $"Multiplexer arduino Log In"  # shift register
      s2 = "Multiple Acquire Dark Current cluster.gtype" []  # shift register
      s3 = w2  # shift register
      for (iteration -> i1) {
        w13 = each element of w4
        call "Multiplexer Arduino Control.gvi"(Arduino Multiplexer Address In=w3, Cell Label=w13, Error In=w12) -> (Arduino Multiplexer Log=w14, Error Out=w15)
        Concatenate Strings(s1, w14) -> w16
        call "Wait In line ms.gvi"(Error In=w15, milliseconds to wait=200) -> (Error Out=w17)
        call "Dark current Measurement.gvi"(Keithley Address=s3, Fiannium Pe Handler=w8, Error In=w17, Dark Current Aveages=w9) -> (Dark current Value=w18, Keythley address out=w19, Error Out=w20)
        $"Dark Current" <- w18
        call "Global Abort.gvi"(Instruction="Read Abort State", Error In=w20) -> (Local Abort State=w21, Global Abort State=w22, Error Out=w23)
        Logical Or(w23, w21, w22) -> w24
        Property Node(instance in=T1 {all zero or empty}, "Cell Label"=w13, "Dark Current"=w18) -> (instance out=w25)
        Insert Into Array(inArray=s2, index0=i1, new=w25) -> w26
        next s1 = w16
        next s2 = w26
        next s3 = w19
        stop if w24
      }
      $"Multiplexer arduino log out" <- s1
      call "Set Measurement Count.gvi"(VISA resource name=s3, Measurement Count=w7, error in (no error)=w23) -> (VISA resource name out=w27, error out=w10)
      $"Keythley address out" <- w27
      $"All Dark Currents" <- s2
    }
  }
  $"Error Out" <- w10
