vi "Multiple Acquire Notification Handler.gvi"   [LabVIEW NXG 5.0.0]
inputs:
  "Input": cluster{"Element 1": f64[], "Element 2": f64[]}[]
  "Input_2": "Automatic Measurement Indicators.gtype"
  "notification": "Multiple aquire notification constant.gtype"
  "timed out?": bool
  "Current λ (nm) _2": f64
  "Progress %_2": f64
  "error out_2": error
outputs:
  "Automatic EQE Measurement Graph": cluster{"Element 1": f64[], "Element 2": f64[]}[]
  "Automatic Measurement Indicators In": "Automatic Measurement Indicators.gtype"
  "Current λ (nm)": f64
  "Progress %": f64
  "input 0": bool
  "Error In": error
types:
  "Multiple aquire notification constant.gtype" = cluster{"Current Value (A)  ": f64, "EQE (%)": f64, "Dark Current (A)": f64, "Cell being measured": string, "Automatic EQE Measurement Graph": cluster{"Element 1": f64[], "Element 2": f64[]}[], "Finished": bool, "Current Wavelength": f64, "Progress": f64}
  "Automatic Measurement Indicators.gtype" = cluster{"Elapsed Time (kr)": f64, "Estimated Time (kr)": f64, "Cell being measured": string, "Current Value (A)  ": f64, "EQE (%)": f64, "Dark Current (A)": f64}
uses:
  EQE_Measuring_Setup_NanOpto::SubVis::FGV::Timer FGV.gvi
diagram:
  case ($"timed out?") {
    frame True {
      w1 = FALSE
      w2 = $"error out_2"
      w3 = $Input_2
      w4 = $Input
      w5 = $"Progress %_2"
      w6 = $"Current λ (nm) _2"
    }
    frame False {
      Property Node(instance in=$notification) -> ("Current Value (A)  "=w7, "EQE (%)"=w8, "Dark Current (A)"=w9, "Cell being measured"=w10, "Automatic EQE Measurement Graph"=w11, "Finished"=w1, "Current Wavelength"=w6, "Progress"=w5)
      call "Timer FGV.gvi"(Timer FGV Instructions="Read Time", Error In=$"error out_2") -> (Elapsed Time=w12, Error Out=w2)
      Property Node(instance in=$Input_2, "Cell being measured"=w10, "Current Value (A)  "=w7, "EQE (%)"=w8, "Dark Current (A)"=w9, "Elapsed Time (kr)"=w12) -> (instance out=w3)
      Is Empty Array(array=w11) -> w13
      Select(s=w13, t=$Input, f=w11) -> w4
    }
  }
  $"Automatic EQE Measurement Graph" <- w4
  $"Automatic Measurement Indicators In" <- w3
  $"Error In" <- w2
  $"Current λ (nm)" <- w6
  $"Progress %" <- w5
  $"input 0" <- w1
