vi "Multiple Aquire Sequence.gvi"   [LabVIEW NXG 5.0.0]
inputs:
  "Multiple acquire variables control": "Multiple acquire variables control.gtype"
  "Error In": error
  "Notifier In": Notifier<"Multiple aquire notification constant.gtype">
outputs:
  "Error Out": error
  "XZ Carriage Arduino Log": string
  "Arduino Multiplexer Log": string
  "XZ Scan Intensity Graph": f64[][]
panel indicators:
  "Auto EQE Measurement": cluster{"Element 1": f64[], "Element 2": f64[]}[]
  "EQE (%)": f64
  "Wavelength (nm)": f64
  "Current (A)": f64
  "notifier name": string
  "Full Multiple EQE Data": f64[][][]
  "Output Multi Graph": cluster{"Element 1": f64[], "Element 2": f64[]}[]
  "Dark Current": f64
types:
  "Multiple aquire notification constant.gtype" = cluster{"Current Value (A)  ": f64, "EQE (%)": f64, "Dark Current (A)": f64, "Cell being measured": string, "Automatic EQE Measurement Graph": cluster{"Element 1": f64[], "Element 2": f64[]}[], "Finished": bool, "Current Wavelength": f64, "Progress": f64}
  "R.01 Reference Coordinates.gtype" = cluster{"X coordinate R.01": f64, "Z coordinate R.01": f64, "Vertical Spacing": f64}
  "Multiple acquire variables control.gtype" = cluster{"Monochromator configuration file ": path, "Light Power Calibration Data": f64[][], "Cell Measuring Labels": string[], "Sample Prefix": string, "Author Initials": string, "Current Date": string, "Batch Name": string, "Default Data Saving Location": path, "Filter Arduino Status": bool, "Filter Arduino Address": "VISA Instr", "Multiplexer Arduino Address": "VISA Instr", "Carriage Arduino Address": "VISA Instr", "Keithley Address": "VISA Instr", "Current Averages   ": f64, "Manual Range  ": f64, "Max current": f64, "Voltage Applied (V)  ": f64, "Autorange  ": bool, "Dark Current  ": bool, "Wavelength for peak detection": f64, "R.01 Reference Coordinates": "R.01 Reference Coordinates.gtype", "R.01 Scan?": bool, "Z scan steps": f64, "X scan Range (mm)": f64, "Z scan Range (mm)": f64, "X scan steps": f64, "Reference Coordinates file": path, "Save R.01 Coordinate?": bool, "Fianium Pe Handler": u64, "Automatic Measurement?": bool, "Dead Cell 10mV Current Threshold": f64, "Precheck cells?": bool, "Monochromator": bool}
  T1 = cluster{"Cell Label": string, "Dark Current": f64}
  "Multiple Acquire Dark Current cluster.gtype" = T1[]
  "Single Acquire Notification control.gtype" = cluster{"Wavelength (nm)": f64, "EQE (%)": f64, "Current (A)": f64, "Finnished": bool, "Progress": f64}
  "Single acquire inputs control.gtype" = cluster{"Light calibration data": f64[][], "Fiannium Configuration File": path, "Arduino Filter Flipper Address": "VISA Instr", "Filter Arduino Status": bool, "Dark Current Averages": f64, "Measure dark current?": bool, "Keithley Address": "VISA Instr", "Current Aveages": i32, "Voltage Applied (V)": f64, "Max current compliance": f64, "Manual Current Range": f64, "Enable Auto Range": bool, "Automatic measurement": bool, "Fiannium Pe Handler": u64, "Dead Cell? Current Threshold": f64, "Automatic measurement Cell Dark current": f64, "Monocrhomator": bool}
uses:
  EQE_Measuring_Setup_NanOpto::SubVis::Utilities::Other::Current Time Kr.gvi
  EQE_Measuring_Setup_NanOpto::SubVis::Instrument Control::Arduinos::XZ Carriage Arduino::XZ Carriage Arduino Initialize.gvi
  EQE_Measuring_Setup_NanOpto::SubVis::Instrument Control::Arduinos::XZ Carriage Arduino::XZ Carriage Arduino Homing Sequence.gvi
  PE_Filter_SDK::Monochromator Initialization Sequence.gvi
  EQE_Measuring_Setup_NanOpto::SubVis::Main Sub Functions::Acquire::Multiple Acquire::Multiple Acquire Dark current Measurement.gvi
  EQE_Measuring_Setup_NanOpto::SubVis::Instrument Control::Arduinos::XZ Carriage Arduino::XZ Scan R.01::XZ Carriage scan routine.gvi
  EQE_Measuring_Setup_NanOpto::SubVis::FGV::Estimated Time FGV.gvi
  EQE_Measuring_Setup_NanOpto::SubVis::FGV::Current State FGV.gvi
  EQE_Measuring_Setup_NanOpto::SubVis::Main Sub Functions::Global Abort::Global Abort.gvi
  EQE_Measuring_Setup_NanOpto::SubVis::Instrument Control::Arduinos::XZ Carriage Arduino::XZ Carriage Label to Coordinate.gvi
  EQE_Measuring_Setup_NanOpto::SubVis::Instrument Control::Arduinos::XZ Carriage Arduino::XZ Carriage Arduino Move to location.gvi
  EQE_Measuring_Setup_NanOpto::SubVis::Instrument Control::Arduinos::Multiplexer Arduino::Multiplexer Arduino Control.gvi
  EQE_Measuring_Setup_NanOpto::SubVis::Main Sub Functions::Acquire::Multiple Acquire::Dark Current cell label Sanity Check.gvi
  EQE_Measuring_Setup_NanOpto::SubVis::Main Sub Functions::Acquire::Single Acquire::Single EQE Measurement Acquire.gvi
  EQE_Measuring_Setup_NanOpto::SubVis::Main Sub Functions::Acquire::Multiple Acquire::Multiple Acquire Notification Builder.gvi
  NI::G Core::Error::Multiplex Errors.gvi
  NI::G Core::Error::Clear Error Cluster.gvi
  EQE_Measuring_Setup_NanOpto::SubVis::FGV::Sample Prefix FGV.gvi
  EQE_Measuring_Setup_NanOpto::SubVis::Main Sub Functions::Acquire::Save EQE TXT File.gvi
  NI::VISA::Close (Instr).gvi
  Labview_NXG_Keithley_SMU_2450_2460_2461::Miscelaneous::Close.gvi
  PE_Filter_SDK::PE Close.gvi
  PE_Filter_SDK::PE Destroy.gvi
diagram:
  case ($"Error In") {
    frame Error, Default {
      w1 = $"Error In"
    }
    frame No Error {
      Property Node(instance in=$"Multiple acquire variables control") -> ("Carriage Arduino Address"=w2, "Dark Current  "=w3, "Monochromator configuration file "=w4, "R.01 Scan?"=w5)
      case (TRUE) {
        frame False, Default {
          w6 = $"Error In"
        }
        frame True {
          w7 = "Automatic Acquire Started!\nPlease wait while the Carriage is \nhoming and positioning itself."
          One Button Dialog(button name ("OK")="Okay I'll be patient", message=w7)
          w6 = $"Error In"
        }
      }
      call "Current Time Kr.gvi"(Error=w6) -> (Current Time (kr)=w8, Error Out=w9)
      call "XZ Carriage Arduino Initialize.gvi"(XZ Carriage Arduino Adress In=w2, Error In=w9) -> (XZ Carriage Arduino Open Visa Session Out=w10, XZ Carriage Arduino Log=w11, Error Out=w12)
      $"XZ Carriage Arduino Log" <- w11
      call "XZ Carriage Arduino Homing Sequence.gvi"(XZ Carriage Arduino Open Visa Session In=w10, XZ Carriage Arduino Log In=w11, Error In=w12) -> (XZ Carriage Arduino Open Visa Session Out=w13, XZ Carriage Arduino Log Out=w14, Error Out=w15)
      call "Monochromator Initialization Sequence.gvi"(Configuration File=w4, Error In=w15) -> (peHandle out=w16, Error Out=w17)
      Property Node(instance in=$"Multiple acquire variables control", "Fianium Pe Handler"=w16) -> (instance out=w18)
      case (w3) {
        frame False, Default {
          w19 = w17
          w20 = "Multiple Acquire Dark Current cluster.gtype" []
          w21 = w18
        }
        frame True {
          call "Multiple Acquire Dark current Measurement.gvi"(Multiple acquire variables control=w18, Multiplexer arduino Log In=$"Arduino Multiplexer Log", Error In=w17) -> (All Dark Currents=w20, Multiplexer arduino log out=w22, Error Out=w19)
          $"Arduino Multiplexer Log" <- w22
          w21 = w18
        }
      }
      case (w5) {
        frame False, Default {
          w23 = w19
          w24 = w21
        }
        frame True {
          call "XZ Carriage scan routine.gvi"(Multiple acquire variable Control=w21, Operation Mode Selection="In program normal operation", Error In=w19) -> (Multiple acquire variable Control Out=w24, Intensity Graph=w25, Error Out=w23)
          $"XZ Scan Intensity Graph" <- w25
        }
      }
      call "Current Time Kr.gvi"(Error=w23) -> (Current Time (kr)=w26, Error Out=w27)
      Property Node(instance in=w24) -> ("R.01 Reference Coordinates"=w28, instance out=w29)
      Property Node(instance in=w24) -> ("Cell Measuring Labels"=w30)
      Subtract(x=w26, y=w8) -> w31
      s1 = w27  # shift register
      s2 = w13  # shift register
      s3 = w14  # shift register
      s4 = f64[][][] []  # shift register
      s5 = $"Notifier In"  # shift register
      s6 = w29  # shift register
      for (iteration -> i1) {
        w32 = each element of w30
        w33 = each element of w20
        Property Node(instance in=$"Multiple acquire variables control") -> ("Multiplexer Arduino Address"=w35)
        call "Current Time Kr.gvi"(Error=s1) -> (Current Time (kr)=w36, Error Out=w37)
        Array Size(array=w30) -> (size(s)=w38)
        Feedback Node(initial value=w8, input=w36) -> w39
        Subtract(x=w36, y=w39) -> w40
        call "Estimated Time FGV.gvi"(Estimated Time Instructions="Setup", Fixed Ammount of Time=w31, Step Count=w38, Step Duration=w40, Error In=w37) -> (Error Out=w41)
        call "Current State FGV.gvi"(Instruction Current State FGV="Set current State", Crrent State="Multiple Acquire", Error In=w41) -> (Error Out=w42)
        call "Global Abort.gvi"(Instruction="Read Abort State", Error In=w42) -> (Local Abort State=w43, Global Abort State=w44, Error Out=w45)
        call "XZ Carriage Label to Coordinate.gvi"(Cell Label=w32, R.01 Reference Coordinates=w28, Error In=w45) -> (Gcode Instruction Out=w46, Error Out=w47)
        call "XZ Carriage Arduino Move to location.gvi"(XZ Carriage Arduino open Visa session In=s2, XZ Carriage Arduino Log In=s3, Input Command=w46, Error In=w47) -> (XZ Carriage Arduino open Visa Session Out=w48, XZ Carriage Arduino Log Out=w49, Error Out=w50)
        call "Multiplexer Arduino Control.gvi"(Arduino Multiplexer Address In=w35, Cell Label=w32, Error In=w50) -> (Arduino Multiplexer Log=w51, Error Out=w52)
        Concatenate Strings($"Arduino Multiplexer Log", w51) -> w53
        $"Arduino Multiplexer Log" <- w53
        $"XZ Carriage Arduino Log" <- s3
        call "Dark Current cell label Sanity Check.gvi"(Cel label=w32, Current cell Dark Current Info=w33, Multiple acquire variables control=s6) -> (Dark Current=w54)
        w55 = "Single Acquire Notification control.gtype" {all zero or empty}
        Obtain Notifier(element data type=w55, error in=w52, name="Multi acquire single measurement") -> (error out=w56, notifier out=w57)
        Property Node(instance in=s6) -> ("Monochromator configuration file "=w58, "Light Power Calibration Data"=w59, "Filter Arduino Status"=w60, "Filter Arduino Address"=w61, "Dark Current  "=w62, "Keithley Address"=w63, "Current Averages   "=w64, "Voltage Applied (V)  "=w65, "Max current"=w66, "Manual Range  "=w67, "Fianium Pe Handler"=w68, "Autorange  "=w69, "Dead Cell 10mV Current Threshold"=w70, "Monochromator"=w71, instance out=w72)
        Property Node(instance in="Single acquire inputs control.gtype" {all zero or empty}, "Light calibration data"=w59, "Fiannium Configuration File"=w58, "Arduino Filter Flipper Address"=w61, "Filter Arduino Status"=w60, "Measure dark current?"=w62, "Keithley Address"=w63, "Current Aveages"=w64, "Voltage Applied (V)"=w65, "Max current compliance"=w66, "Manual Current Range"=w67, "Enable Auto Range"=w69, "Automatic measurement"=TRUE, "Fiannium Pe Handler"=w68, "Dead Cell? Current Threshold"=w70, "Monocrhomator"=w71) -> (instance out=w73)
        call "Single EQE Measurement Acquire.gvi"(Single acquire inputs control=w73, Notifier In=w57, Error In=w56) -> (Full EQE Data=w74, Error Out=w75)
        Property Node(instance in=$"Multiple acquire variables control") -> ("Default Data Saving Location"=w76, "Author Initials"=w77, "Current Date"=w78, "Batch Name"=w79, "Dark Current  "=w80)
        Divide(x=i1, y=w38) -> w81
        s7 = w57  # shift register
        s8 = s5  # shift register
        s9 = w56  # shift register
        s10 = f64[][] []  # shift register
        while {
          call "Global Abort.gvi"(Instruction="Read Abort State", Error In=s9) -> (Local Abort State=w82, Global Abort State=w83, Error Out=w84)
          Logical Or(w82, w83) -> w85
          Wait On Notification(error in (no error)=w84, notifier=s7, timeout in milliseconds=1000) -> (error out=w86, notification=w87, notifier out=w88, timed out?=w89)
          case (w89) {
            frame True {
              w90 = s10
              w91 = FALSE
              w92 = s4
              w93 = w86
              w94 = s8
            }
            frame False {
              call "Multiple Acquire Notification Builder.gvi"(Input_7=s8, Input_4=s4, Current Step=i1, Wavelength EQE Single Array=s10, Input_6=w32, Single Acquire notification in=w87, Dark Current=$"Dark Current", Error In=w86, External Progress Bar=w81, Total Steps=w38) -> (Output=w94, Output_4=w92, Output_3=w90, Current (A)=w95, EQE (%)=w96, Auto EQE Measurement=w97, Wavelength (nm)=w98, Output_2=w91, Error Out=w93)
              $"Current (A)" <- w95
              $"EQE (%)" <- w96
              $"Auto EQE Measurement" <- w97
              $"Output Multi Graph" <- w97
              $"Wavelength (nm)" <- w98
            }
          }
          Logical Or(w91, w85) -> w99
          next s7 = w88
          next s8 = w94
          next s9 = w93
          next s10 = w90
          stop if w99
        }
        Logical Or(w43, w44) -> w100
        Decrement(x=w38) -> w101
        Is Greater Or Equal(x=i1, y=w101) -> w102
        Logical Or(w102, w100) -> w103
        w104 = "Multiple aquire notification constant.gtype" {all zero or empty}
        Property Node(instance in=w104, "Finished"=w103) -> (instance out=w105)
        call "Multiplex Errors.gvi"(error in 1=w75, error in 2=s9) -> (error out=w106)
        Send Notification(error in (no error)=w106, notification=w105, notifier=s8) -> (error out=w107, notifier out=w108)
        call "Clear Error Cluster.gvi"(error in=w107) -> (error out=w109)
        Release Notifier(error in (no error)=w109, notifier=s7) -> (error out=w110, notifier name=w111)
        call "Current State FGV.gvi"(Instruction Current State FGV="Set current State", Crrent State="Save TXT EQE file", Error In=w110) -> (Error Out=w112)
        call "Sample Prefix FGV.gvi"(General instruction FGV enum="Read state", Error In=w112) -> (Sample Prefix Out=w113, Error Out=w114)
        call "Save EQE TXT File.gvi"(Dark Current=w54, Dark Current Measured?=w80, Default Data Saving Location=w76, Full EQE Data=w74, Author Initials=w77, Sample Prefix=w113, Current Date=w78, Batch Name=w79, Error In=w114, Path type="Multiple EQE", Cell Label=w32) -> (Error Out=w115)
        $"notifier name" <- w111
        $"Dark Current" <- w54
        append w74 to w34
        next s1 = w115
        next s2 = w48
        next s3 = w49
        next s4 = w92
        next s5 = w108
        next s6 = w72
        stop if w100
      }
      Property Node(instance in=s6) -> ("Keithley Address"=w116, "Fianium Pe Handler"=w117)
      call "Close (Instr).gvi"(session in=s2, error in=s1) -> (error out=w118)
      call "Close.gvi"(VISA resource name=w116, error in (no error)=w118) -> (error out=w119)
      call "PE Close.gvi"(peHandle=w117, error in (no error)=w119) -> (peHandle out=w120, error out=w121)
      call "PE Destroy.gvi"(peHandle=w120, error in (no error)=w121) -> (error out=w122)
      case (TRUE) {
        frame False, Default {
          w1 = w122
        }
        frame True {
          One Button Dialog(button name ("OK")="Okay Thanks", message="Automatic Acquire finished!")
          w1 = w122
        }
      }
      $"XZ Carriage Arduino Log" <- w14
      $"Full Multiple EQE Data" <- w34
    }
  }
  $"Error Out" <- w1
