vi "Single EQE Measurement Acquire.gvi"   [LabVIEW NXG 5.0.0]
inputs:
  "Single acquire inputs control": "Single acquire inputs control.gtype"
  "Notifier In": Notifier<"Single Acquire Notification control.gtype">
  "Error In": error
outputs:
  "Error Out": error
  "Dark Current": f64
  "Full EQE Data": f64[][]
  "Notifier Out": Notifier<"Single Acquire Notification control.gtype">
panel indicators:
  "Current measurements": f64[]
  "spreadsheet string": string
types:
  "Single acquire inputs control.gtype" = cluster{"Light calibration data": f64[][], "Fiannium Configuration File": path, "Arduino Filter Flipper Address": "VISA Instr", "Filter Arduino Status": bool, "Dark Current Averages": f64, "Measure dark current?": bool, "Keithley Address": "VISA Instr", "Current Aveages": i32, "Voltage Applied (V)": f64, "Max current compliance": f64, "Manual Current Range": f64, "Enable Auto Range": bool, "Automatic measurement": bool, "Fiannium Pe Handler": u64, "Dead Cell? Current Threshold": f64, "Automatic measurement Cell Dark current": f64, "Monocrhomator": bool}
  "Single Acquire Notification control.gtype" = cluster{"Wavelength (nm)": f64, "EQE (%)": f64, "Current (A)": f64, "Finnished": bool, "Progress": f64}
uses:
  EQE_Measuring_Setup_NanOpto::SubVis::Instrument Control::Keithley::Keithley Initialization Sequence.gvi
  PE_Filter_SDK::Monochromator Initialization Sequence.gvi
  EQE_Measuring_Setup_NanOpto::SubVis::FGV::Current State FGV.gvi
  EQE_Measuring_Setup_NanOpto::SubVis::Instrument Control::Arduinos::Filter Flipper Arduino::Filter Plipper Arduino set to IR pass.gvi
  EQE_Measuring_Setup_NanOpto::SubVis::Instrument Control::Keithley::Dark current Measurement.gvi
  Labview_NXG_Keithley_SMU_2450_2460_2461::Configure::Set Measurement Count.gvi
  EQE_Measuring_Setup_NanOpto::SubVis::Utilities::Other::Light Calibration parameters extractor.gvi
  EQE_Measuring_Setup_NanOpto::SubVis::Utilities::Other::Wavelength loop calculation.gvi
  EQE_Measuring_Setup_NanOpto::SubVis::Instrument Control::Monochromator::Filter Wavelength nm Crossing ka.gvi
  EQE_Measuring_Setup_NanOpto::SubVis::Instrument Control::Arduinos::Filter Flipper Arduino::Filter Flipper arduino flip subroutine.gvi
  Labview_NXG_Keithley_SMU_2450_2460_2461::Configure::Clear Buffer.gvi
  Labview_NXG_Keithley_SMU_2450_2460_2461::Configure::Configure Integration Filter.gvi
  Labview_NXG_Keithley_SMU_2450_2460_2461::Action Status::Enable Output.gvi
  EQE_Measuring_Setup_NanOpto::SubVis::Main Sub Functions::Acquire::Single Acquire::Keithley adaptative measurement setup.gvi
  EQE_Measuring_Setup_NanOpto::SubVis::Utilities::Other::Wavelength detection filter flipper routine.gvi
  EQE_Measuring_Setup_NanOpto::SubVis::Instrument Control::Monochromator::Set Wavelength Function.gvi
  EQE_Measuring_Setup_NanOpto::SubVis::Main Sub Functions::Global Abort::Global Abort.gvi
  EQE_Measuring_Setup_NanOpto::SubVis::FGV::Skip To next Cell FGV.gvi
  Labview_NXG_Keithley_SMU_2450_2460_2461::Data::Make Reading and Store in Buffer.gvi
  Labview_NXG_Keithley_SMU_2450_2460_2461::Data::Read (Multiple Points).gvi
  NI::Analysis::Statistics::Mean (DBL).gvi
  EQE_Measuring_Setup_NanOpto::SubVis::Utilities::Messages And Prompts::Erase Notification Error.gvi
  Labview_NXG_Keithley_SMU_2450_2460_2461::Miscelaneous::Close.gvi
  PE_Filter_SDK::PE Close.gvi
  PE_Filter_SDK::PE Destroy.gvi
diagram:
  Property Node(instance in=$"Single acquire inputs control") -> ("Enable Auto Range"=w1, "Fiannium Configuration File"=w2, "Arduino Filter Flipper Address"=w3, "Filter Arduino Status"=w4, "Dark Current Averages"=w5, "Measure dark current?"=w6, "Keithley Address"=w7, "Current Aveages"=w8, "Voltage Applied (V)"=w9, "Max current compliance"=w10, "Manual Current Range"=w11, "Automatic measurement"=w12, "Fiannium Pe Handler"=w13, "Monocrhomator"=w14)
  Logical And(not w12, w6) -> w15
  case (w12) {
    frame True {
      # If it is an automatic measurement
      # both the keithley and the fiannium will have been
      # initialized
      call "Keithley Initialization Sequence.gvi"(Enable Auto Range=w1, VISA resource name=w7, Voltage Applied (V)=w9, Source Limit Level (0.1)=w10, Current Averages=w8, Error In=$"Error In", Manual Current Range=w11) -> (VISA resource name out=w16, Error Out=w18)
      w17 = w13
    }
    frame False {
      call "Keithley Initialization Sequence.gvi"(Enable Auto Range=w1, VISA resource name=w7, Voltage Applied (V)=w9, Source Limit Level (0.1)=w10, Current Averages=w8, Error In=$"Error In", Manual Current Range=w11) -> (VISA resource name out=w16, Error Out=w19)
      call "Monochromator Initialization Sequence.gvi"(Configuration File=w2, Error In=w19) -> (peHandle out=w17, Error Out=w18)
    }
  }
  case (w15) {
    frame False, Default {
      # If It is an automatic measurement or we do not want
      # to measure the dark current we just pass the info
      w20 = w16
      w21 = w18
      w22 = w17
    }
    frame True {
      To Signed 32 Bit Integer(number=w5) -> w23
      call "Current State FGV.gvi"(Instruction Current State FGV="Set Current SubState", Current SubState="Measuring Dark Current", Error In=w18) -> (Error Out=w24)
      call "Filter Plipper Arduino set to IR pass.gvi"(Arduino Filter Flipper Address=w3, Filter Arduino Status=w4, Error In=w24) -> (Error Out=w25)
      call "Dark current Measurement.gvi"(Keithley Address=w16, Fiannium Pe Handler=w17, Close Coms after finish?=FALSE, Error In=w25, Monochromator=w14, Dark Current Aveages=w23) -> (Dark current Value=w26, Pe Handle out=w22, Keythley address out=w27, Error Out=w28)
      $"Dark Current" <- w26
      call "Set Measurement Count.gvi"(VISA resource name=w27, Measurement Count=w8, error in (no error)=w28) -> (VISA resource name out=w20, error out=w21)
    }
  }
  case (w21) {
    frame Error, Default {
      w30 = "Single Acquire Notification control.gtype" {all zero or empty}
      Send Notification(notification=w30, notifier=$"Notifier In")
      w29 = w21
    }
    frame No Error {
      Property Node(instance in=$"Single acquire inputs control") -> ("Filter Arduino Status"=w31, "Arduino Filter Flipper Address"=w32, "Light calibration data"=w33, "Dead Cell? Current Threshold"=w34)
      call "Light Calibration parameters extractor.gvi"(Light calibration data=w33) -> (End Wavelength (nm) Current Calibration=w35, Wavelength Step (nm) Current Calibration=w36, Start Wavelength (nm) Current Calibration=w37)
      call "Wavelength loop calculation.gvi"(Wavelength Step (nm)=w36, End Wavelength (nm)=w35, Start Wavelength (nm)=w37) -> (Ammount of steps +1 (for the loop)=w38, Positive or negative steps=w39, Exact ammount of steps=w40)
      call "Filter Wavelength nm Crossing ka.gvi"(Light Power Calibration Data=w33) -> (Crosses the Change Grating Wavelength Frontier?=w41)
      call "Filter Flipper arduino flip subroutine.gvi"(Start Wavelength (nm) Current Calibration=w37, Filter Arduino Status=w31, Arduino Filter Flipper Address=w32, Error In=w21) -> (Error Out=w42)
      call "Clear Buffer.gvi"(VISA resource name=w20, error in (no error)=w42) -> (VISA resource name out=w43, error out=w44)
      call "Configure Integration Filter.gvi"(VISA resource name=w43, Measurement Speed (1 PLC)=0.5, error in (no error)=w44) -> (VISA resource name out=w45, error out=w46)
      call "Enable Output.gvi"(VISA resource name=w45, Enable Output (T: Enable)=TRUE, error in (no error)=w46) -> (VISA resource name out=w47, error out=w48)
      s1 = w48  # shift register
      s2 = w22  # shift register
      s3 = w47  # shift register
      s4 = f64[][] []  # shift register
      s5 = $"Notifier In"  # shift register
      s6 = uninitialised  # shift register
      s6.prev1 = uninitialised  # shift register
      s6.prev2 = uninitialised  # shift register
      for (N = w38) (iteration -> i1) {
        Wait Until Next Multiple(multiple to wait=5)
        To Double Precision Float(number=i1) -> w49
        Multiply(w36, w49, w39) -> w50
        Add(w50, w37) -> w51
        call "Current State FGV.gvi"(Instruction Current State FGV="Set Current SubState", Current SubState="Measuring with Keithley", Error In=s1) -> (Error Out=w52)
        call "Keithley adaptative measurement setup.gvi"(Keithley address in=s3, Last Measurement=s6, 2nd Last Measurement=s6.prev1, 3nd Last Measurement=s6.prev2, threshold=w34, loop iteration=i1, Error Out=w52, Single acquire inputs control=$"Single acquire inputs control") -> (Keythley address out=w53, Error In=w54)
        # w55: Light power at current wavelength
        Property Node(instance in=$"Single acquire inputs control") -> ("Current Aveages"=w56, "Filter Arduino Status"=w57, "Arduino Filter Flipper Address"=w58, "Monocrhomator"=w59)
        call "Wavelength detection filter flipper routine.gvi"(Current Wavelength=w51, Arduino Filter Flipper Status=w57, Arduino Filter Flipper Address=w58, Crossing Ka=w41, Error In=w54) -> (Error Out=w60)
        call "Set Wavelength Function.gvi"(PE Fiannium Handle In=s2, Wavelength=w51, Monochromator=w59, Error In=w60) -> (PE Fiannium Handle Out=w61, Error Out=w62)
        # w63: Buffer start index
        call "Global Abort.gvi"(Instruction="Read Abort State", Error In=w62) -> (Local Abort State=w64, Global Abort State=w65, Error Out=w66)
        call "Skip To next Cell FGV.gvi"(General instruction FGV enum="Read state", Error In=w66) -> (Skip cell? out=w67, Error Out=w68)
        call "Make Reading and Store in Buffer.gvi"(VISA resource name=w53, error in (no error)=w68) -> (VISA resource name out=w69, error out=w70)
        Multiply(i1, w56) -> w71
        Add(w71, w56) -> w72
        To Unsigned 32 Bit Integer(number=w72) -> w73
        # w72: Buffer end index
        Increment(x=w71) -> w63
        To Unsigned 32 Bit Integer(number=w63) -> w74
        call "Read (Multiple Points).gvi"(VISA resource name=w69, Timeout (10000 ms)=30000, Start Index (1)=w74, End Index (1)=w73, error in (no error)=w70) -> (VISA resource name out=w75, Data out=w76, error out=w77)
        Spreadsheet String To Array(array type=f64[] [], delimiter=",", format string="%g", spreadsheet string=w76) -> (array=w78)
        # w79: Current (A)
        call "Mean (DBL).gvi"(x=w78, error in=w77) -> (mean=w79, error out=w80)
        Divide(x=1240, y=w51) -> w81
        Array Index(array=w33) -> (out0[i1, 1]=w55)
        Divide(x=w79, y=w55) -> w82
        Multiply(w82, w81, 100) -> w83
        # w84: EQE (%)
        Absolute Value(x=w83) -> w84
        Build Array(w51, w84, w79) -> w85
        Insert Into Array(inArray=s4, index0=i1, new=w85) -> w86
        $"spreadsheet string" <- w76
        $"Current measurements" <- w78
        To Double Precision Float(number=w38) -> w87
        To Double Precision Float(number=i1) -> w88
        Divide(x=w88, y=w87) -> w89
        Multiply(w89, 100) -> w90
        Is Greater Or Equal(x=i1, y=w40) -> w91
        Logical Or(w64, w65, w67) -> w92
        Logical Or(w91, w92) -> w93
        w94 = "Single Acquire Notification control.gtype" {all zero or empty}
        Property Node(instance in=w94, "Wavelength (nm)"=w51, "EQE (%)"=w84, "Current (A)"=w79, "Finnished"=w93, "Progress"=w90) -> (instance out=w95)
        Send Notification(error in (no error)=w80, notification=w95, notifier=s5) -> (error out=w96, notifier out=w97)
        call "Erase Notification Error.gvi"(error out_2=w96) -> (Output=w98)
        Absolute Value(x=w79) -> w99
        next s1 = w98
        next s2 = w61
        next s3 = w75
        next s4 = w86
        next s5 = w97
        next s6 = w99
        stop if w92
      }
      Property Node(instance in=$"Single acquire inputs control") -> ("Automatic measurement"=w100)
      call "Skip To next Cell FGV.gvi"(General instruction FGV enum="Reset State", Error In=s1) -> (Error Out=w101)
      call "Enable Output.gvi"(VISA resource name=s3, Enable Output (T: Enable)=FALSE, error in (no error)=w101) -> (VISA resource name out=w102, error out=w103)
      call "Clear Buffer.gvi"(VISA resource name=w102, error in (no error)=w103) -> (VISA resource name out=w104, error out=w105)
      case (w100) {
        frame True {
          # If it is an automatic measurement
          # we leave the keithley running
          # and also the monochromator
          w29 = w105
        }
        frame False {
          call "Close.gvi"(VISA resource name=w104, error in (no error)=w105) -> (error out=w106)
          call "PE Close.gvi"(peHandle=s2, error in (no error)=w106) -> (peHandle out=w107, error out=w108)
          call "PE Destroy.gvi"(peHandle=w107, error in (no error)=w108) -> (error out=w29)
        }
      }
      $"Notifier Out" <- s5
      $"Full EQE Data" <- s4
    }
  }
  $"Error Out" <- w29
