vi "Light calibration.gvi"   [LabVIEW NXG 3.1.0]
inputs:
  "End Wavelength (nm)": f64 = 1100
  "Wavelength Step (nm)": f64 = 2
  "Start Wavelength (nm)": f64 = 400
  "Error In": error
  "Notifier Input": Notifier<T1>
  "Powermeter Averages": u16 = 5
  "Configuration File": path
  "Arduino Filter Flipper Address": "VISA Instr"
  "Filter Arduino Status": bool
outputs:
  "Error Out": error
  "Notifier Output": Notifier<T1>
  "Light Power Calibration Data": f64[][]
  "Current System": string
panel indicators:
  "Current Power": f64
types:
  T1 = cluster{"Element 1": f64, "Element 2": f64, "Element 3": bool}
uses:
  Main::Photodetector initialization Sequence with prompt.gvi
  PE_Filter_SDK::Monochromator Initialization Sequence.gvi
  EQE_Measuring_Setup_NanOpto::SubVis::Utilities::Messages And Prompts::Manually Place The Filter Message.gvi
  EQE_Measuring_Setup_NanOpto::SubVis::Instrument Control::Monochromator::Filter Change Wavelength.gvi
  EQE_Measuring_Setup_NanOpto::SubVis::Instrument Control::Arduinos::Filter Flipper Arduino::Arduino Filter Flipper Control.gvi
  EQE_Measuring_Setup_NanOpto::SubVis::FGV::Arduino filter FGV current state.gvi
  EQE_Measuring_Setup_NanOpto::SubVis::Utilities::Other::Wavelength loop calculation.gvi
  EQE_Measuring_Setup_NanOpto::SubVis::Instrument Control::Monochromator::Filter Wavelength crossing ligth cal ka.gvi
  EQE_Measuring_Setup_NanOpto::SubVis::Utilities::Other::Wavelength detection filter flipper routine.gvi
  EQE_Measuring_Setup_NanOpto::SubVis::Instrument Control::Monochromator::Fiannium wavelength correction.gvi
  PE_Filter_SDK::PE Set Wavelength On Grating.gvi
  Main::TLPM Set Wavelength.gvi
  Main::TLPM Set Average Count.gvi
  Main::TLPM Measure Power.gvi
  EQE_Measuring_Setup_NanOpto::SubVis::Main Sub Functions::Global Abort::Global Abort.gvi
  NI::G Core::Error::Clear Error Cluster.gvi
  NI::G Core::Error::Read Error Code.gvi
  NI::G Core::Error::Read Location.gvi
  Main::TLPM Close.gvi
  PE_Filter_SDK::PE Close.gvi
  PE_Filter_SDK::PE Destroy.gvi
diagram:
  call "Photodetector initialization Sequence with prompt.gvi"(Error In=$"Error In") -> (Photodetector IVI session=w1, Error Out=w2)
  call "Monochromator Initialization Sequence.gvi"(Configuration File=$"Configuration File", Error In=w2) -> (peHandle out=w3, Current System=w4, Error Out=w5)
  $"Current System" <- w4
  case (w5) {
    frame Error, Default {
      w6 = w5
    }
    frame No Error {
      case ($"Filter Arduino Status") {
        frame False, Default {
          Is Greater Or Equal(x=$"Start Wavelength (nm)", y=650) -> w8
          call "Manually Place The Filter Message.gvi"(IR Pass filter?=w8, Error In=w5) -> (Error Out=w7)
        }
        frame True {
          call "Filter Change Wavelength.gvi"() -> (Wavelength of filter Change=w9)
          Is Greater Or Equal(x=$"Start Wavelength (nm)", y=w9) -> w10
          Select(s=w10, t="IR Pass", f="Visible Pass") -> w11
          call "Arduino Filter Flipper Control.gvi"(Arduino Filter Flipper Address In=$"Arduino Filter Flipper Address", Pass Filter=w11, Error In=w5) -> (Error Out=w12)
          call "Arduino filter FGV current state.gvi"(Arduino Filter Flipper FGV instructions="Set State", Arduino Filter Flipper Instructions In=w11, Error In=w12) -> (Error Out=w7)
        }
      }
      call "Wavelength loop calculation.gvi"(Wavelength Step (nm)=$"Wavelength Step (nm)", End Wavelength (nm)=$"End Wavelength (nm)", Start Wavelength (nm)=$"Start Wavelength (nm)") -> (Ammount of steps +1 (for the loop)=w13, Positive or negative steps=w14, Exact ammount of steps=w15)
      call "Filter Wavelength crossing ligth cal ka.gvi"(Start Wavelength=$"End Wavelength (nm)", End Wavelength=$"Start Wavelength (nm)") -> (Crosses the filter change wavelength?=w16)
      # Initialize Photodetector
      # Initialize monochromator
      s1 = f64[][] []  # shift register
      s2 = $"Notifier Input"  # shift register
      s3 = w7  # shift register
      s4 = w1  # shift register
      s5 = w3  # shift register
      for (N = w13) (iteration -> i1) {
        # Set monochromator wavelength
        Wait Until Next Multiple(multiple to wait=5)
        Multiply($"Wavelength Step (nm)", i1, w14) -> w17
        Add(w17, $"Start Wavelength (nm)") -> w18
        # w18: Current Wavelength
        call "Wavelength detection filter flipper routine.gvi"(Current Wavelength=w18, Arduino Filter Flipper Status=$"Filter Arduino Status", Arduino Filter Flipper Address=$"Arduino Filter Flipper Address", Crossing Ka=w16, Error In=s3) -> (Error Out=w19)
        call "Fiannium wavelength correction.gvi"(Desired wavelength=w18) -> (Grating for the system=w20, Wavelength for the system=w21)
        call "PE Set Wavelength On Grating.gvi"(peHandle=s5, gratingIndex=w20, wavelength=w21, error in (no error)=w19) -> (peHandle out=w22, error out=w23)
        call "TLPM Set Wavelength.gvi"(IVI session in=s4, Wavelength (0.0)=w18, error in (no error)=w23) -> (IVI session out=w24, error out=w25)
        call "TLPM Set Average Count.gvi"(IVI session in=w24, Average Count (1)=$"Powermeter Averages", error in (no error)=w25) -> (IVI session out=w26, error out=w27)
        call "TLPM Measure Power.gvi"(IVI session in=w26, error in (no error)=w27) -> (IVI session out=w28, Power=w29, error out=w30)
        $"Current Power" <- w29
        Build Array(w18, w29) -> w31
        # Measure photodetector power
        Insert Into Array(inArray=s1, index0=i1, new=w31) -> w32
        call "Global Abort.gvi"(Instruction="Read Abort State", Error In=w30) -> (Local Abort State=w33, Global Abort State=w34, Error Out=w35)
        # Set photodetector wavelength
        Is Greater Or Equal(x=i1, y=w15) -> w36
        Logical Or(w33, w34) -> w37
        Logical Or(w36, w37) -> w38
        Build Cluster(w18, w29, w38) -> w39
        Send Notification(error in (no error)=w35, notification=w39, notifier=s2) -> (error out=w40, notifier out=w41)
        case (w40) {
          frame Error, Default {
            call "Clear Error Cluster.gvi"(error in=w40) -> (error out=w43)
            call "Read Error Code.gvi"(error in=w40) -> (code=w44)
            Is Equal(x=w44, y=1) -> w45
            call "Read Location.gvi"(error in=w40) -> (location=w46)
            Search And Replace String(input string=w46, search string="Send Notification") -> (number of replacements=w47)
            Is Greater Than 0(x=w47) -> w48
            Logical And(w48, w45) -> w49
            Select(s=w49, t=w43, f=w40) -> w42
          }
          frame No Error {
            w42 = w40
          }
        }
        next s1 = w32
        next s2 = w41
        next s3 = w42
        next s4 = w28
        next s5 = w22
        stop if w37
      }
      $"Notifier Output" <- s2
      $"Light Power Calibration Data" <- s1
      call "TLPM Close.gvi"(IVI session in=s4, error in (no error)=s3) -> (error out=w50)
      call "PE Close.gvi"(peHandle=s5, error in (no error)=w50) -> (peHandle out=w51, error out=w52)
      call "PE Destroy.gvi"(peHandle=w51, error in (no error)=w52) -> (error out=w6)
    }
  }
  $"Error Out" <- w6
