vi "Initializing app prompt.gvi"   [LabVIEW NXG 3.1.0]
inputs:
  "Error In": error
outputs:
  "Error Out": error
panel indicators:
  "Linear Progress Bar": f64
  "Steps": "Queue instructions.gtype"[]
  "Sub Steps": "Sub states enum.gtype"[]
  "sin": f64
types:
  "Queue instructions.gtype" = enum{"Wrongly pointed State", "Initialize App", "Light Calibration", "Measure Photodetector", "Measure Keithley", "Instrument detection", "Single Acquire", "Multiple Acquire", "EQE Mapping", "Debugging mode", "Move Arduino", "Arduino FF flip filter", "Help routine", "Idle", "Save Calibration", "Load Calibration", "Set Wavelength", "Turn supercontinuum laser on/off", "Set Multiplex arduino cell", "Save TXT EQE file", "Load TXT EQE", "Stop or Idle", "Stop App"}
  "Sub states enum.gtype" = enum{"Not specified", "Measuring Dark Current", "Initializing Keithley", "Initializing Monochromator", "Measuring with Keithley", "Moving Arduino", "Detecting Monochromator", "Detecting Keithley", "Detecting Photodetector", "Detecting Arduinos", "Homing XZ Carriage Arduino", "Moving XZ Carriage Arduino", "Moving Filter Flipper Arduino", "Setting Pin Multiplexer Arduino", "Detecting Supercontinuum", "Scanning R.01 cell position"}
uses:
  EQE_Measuring_Setup_NanOpto::SubVis::FGV::Current State FGV.gvi
diagram:
  Property Node(instance in=reference to unnamed native front panel, error in=$"Error In") -> ("Window"=w1, error out=w2)
  Open Window(reference in=w1, error in=w2) -> (reference out=w3, error out=w4)
  s1 = uninitialised  # shift register
  s2 = 0  # shift register
  s3 = uninitialised  # shift register
  s4 = 0  # shift register
  while (iteration -> i1) {
    call "Beating Star.gvi"(Input=reference to unnamed path, loop iteration=i1, Speed Divider=10) -> (sin=w7)
    $sin <- w7
    Wait Until Next Multiple(multiple to wait=50)
    call "Current State FGV.gvi"(Instruction Current State FGV="Read Current State", Error In=w4) -> (Current State Output=w8, Sub states Output=w9, Error Out=w10)
    Is Not Equal(x=w8, y=s1) -> w11
    Multiply(s2, 15) -> w12
    Increment(x=s4) -> w13
    Add(w12, 15) -> w14
    In Range And Coerce(lower limit=0, upper limit=w14, x=w13) -> (coerced(x)=w15)
    Is Not Equal(x=w9, y=s3) -> w16
    Select(s=w16, t=w12, f=w15) -> w17
    $"Linear Progress Bar" <- w17
    Increment(x=s2) -> w18
    Select(s=w16, t=w18, f=s2) -> w19
    Is Greater(x=i1, y=20000) -> w20
    Is Equal(x=w8, y="Idle") -> w21
    Logical Or(w20, w21) -> w22
    append w8 to w5 if w11
    append w9 to w6 if w16
    next s1 = w8
    next s2 = w19
    next s3 = w9
    next s4 = w17
    stop if w22
  }
  $Steps <- w5
  Close Window(reference in=w3, error in=w10) -> (error out=w23)
  $"Error Out" <- w23
  $"Sub Steps" <- w6
