vi "Write Reference Coordinate File.gvi"   [LabVIEW NXG 5.0.0]
inputs:
  "Input": path
  "R.01 Reference Coordinates": "R.01 Reference Coordinates.gtype" = {"X coordinate R.01"=145.3, "Z coordinate R.01"=2.5, "Vertical Spacing"=0}
  "operation": T1 = "create"
  "Error In": error
outputs:
  "Output": path
  "Output_2": error
types:
  T1 = enum{"open", "replace", "create", "open or create", "replace or create", "replace or create with confirmation"}
  "R.01 Reference Coordinates.gtype" = cluster{"X coordinate R.01": f64, "Z coordinate R.01": f64, "Vertical Spacing": f64}
diagram:
  Cluster To Array(cluster=$"R.01 Reference Coordinates") -> (array=w1)
  Array To Spreadsheet String(array=w1, format string="%g") -> (spreadsheet string=w2)
  Open Or Create Or Replace File(error in=$"Error In", file path (use dialog)=$Input, operation (0:open)=$operation) -> (error out=w3, refnum out=w4)
  Write To Text File(error in=w3, file (use dialog)=w4, text=w2) -> (error out=w5, refnum out=w6)
  Close File(error in=w5, refnum=w6) -> (error out=w7, path=w8)
  $Output <- w8
  $Output_2 <- w7
